# Grasshopper definition 3d conv test 1.gh (Grasshopper 1.0.7)
# plug-ins: Anemone, treesloth01, Pufferfish, Human, ClipperComponents, TT Toolbox, Kangaroo Components, MeshEdit Components, Kangaroo2 Components, Yellow, GH_CPython

# 可分塊數比例
# 可分塊數比例
# 可分塊數比例
# 可分塊數比例
# 可分塊數比例
number_slider = Slider(11, range=0..100)
number_slider_2 = Slider(11, range=0..100)
lng = ListLength(List=flatten(number_slider))
tstat = TreeStatistics(Tree=number_slider)  # -> Paths, Length, Count

# ---- group: clear dataRecoder
toggle = BooleanToggle(False)

# ----
trigger = Trigger(Interval=5000, TimerInterval=5000, Target=counter)  # disabled
number_slider_3 = Slider(5, range=0..10)
counter = Counter(Reset=Toggle(False))

# ----
# start from
panel = Panel("0")

# ----
# need x group
number_slider_4 = Slider(800, range=0..1000)

panel_2 = Panel(number_slider_3)
addition = Addition(A=number_slider_3, B=panel)
smaller = SmallerThan(FirstNumber=number_slider_3, SecondNumber=number_slider_4)  # -> SmallerThan, OrEqualTo
grouplock = GroupLock(active=smaller.SmallerThan, nickName="time")  # -> out; inputs active: Boolean, nickName: String
# ---------- grouplock: C# usings ----------
using System.Drawing;
# ---------- grouplock: C# ----------
    GH_Document gd = this.Component.OnPingDocument();
    foreach(var obj in gd.Objects){
      if(obj.GetType().ToString() == "Grasshopper.Kernel.Special.GH_Group"){
        Grasshopper.Kernel.Special.GH_Group gg = (Grasshopper.Kernel.Special.GH_Group) obj;
        if(gg.NickName == nickName ){
          for(int i = 0;i < gg.Objects().Count;i++){
            IGH_Component gc = gd.FindComponent(gg.ObjectIDs[i]);
            if(gc != null){
              LockComponent(gc, active);//锁定电池
            }
            else{
              IGH_Param gp = gd.FindParameter(gg.ObjectIDs[i]);
              if(gp != null){
                LockParam(gp, active);//锁定参数
              }
            }
          }
        }
      }
    }
# ---------- grouplock: C# additional code ----------
  void LockComponent (IGH_Component gc, bool active){
    if(active){
      if(gc.Locked == true){
        gc.Locked = false;
        gc.ExpireSolution(true);
      }
    }
    else{
      if(gc.Locked == false){
        gc.Locked = true;
        gc.ExpireSolution(true);
      }
    }
  }

  void LockParam (IGH_Param gp, bool active){
    if(active){
      if(gp.Locked == true){
        gp.Locked = false;
        gp.ExpireSolution(true);
      }
    }
    else{
      if(gp.Locked == false){
        gp.Locked = true;
        gp.ExpireSolution(true);
      }
    }
  }
# ---------- end grouplock ----------
toggle_2 = BooleanToggle(False)  # disabled
number_slider_5 = Slider(6, range=0..100)  # disabled
# 城市生成---數據樹街廓分割
number_slider_6 = Slider(151, range=0..200)  # disabled
not = GateNot(A=toggle_2)  # disabled
smaller_2 = SmallerThan(FirstNumber=addition, SecondNumber=number_slider_6)  # -> SmallerThan, OrEqualTo; disabled
panel_3 = Panel(addition)
null = NullItem(Item=addition)  # -> NullFlags, InvalidFlags, Description; disabled
construct_domain = ConstructDomain(DomainStart="-90", DomainEnd="90")
construct_domain_2 = ConstructDomain(DomainStart="0.3", DomainEnd="0.5")
construct_domain_3 = ConstructDomain(DomainStart="2.5", DomainEnd="6")
panel_4 = Panel("0")  # disabled
filter = StreamFilter(Gate=null.NullFlags, Stream0=smaller_2.SmallerThan, Stream1=panel_4)  # disabled
nn = Panel("time")  # disabled
and = GateAnd(A=filter, B=toggle_2)  # disabled
random = Random(Range=construct_domain, Number=1, Seed=addition)
random_2 = Random(Range=construct_domain_2, Number=1, Seed=addition)
panel_5 = Panel(random_2)
random_3 = Random(Range=construct_domain_3, Number=1, Seed=addition)
panel_6 = Panel(random_3)
grouplock_2 = GroupLock(active=and, nickName=nn)  # -> out; inputs active: Boolean, nickName: String; disabled; same code as grouplock
and_2 = GateAnd(A=filter, B=toggle_2)  # disabled

# ----
# 大樓長寬
number_slider_7 = Slider(15, range=10..30)

crv = Curve(<curve referenced from the Rhino model>)

# ----
# 街廓分割seed
number_slider_8 = Slider(8, range=0..100)

# ----
# 朝向角度
number_slider_9 = Slider(0, range=-180..180)

# ----
# 建物密度
number_slider_10 = Slider(0.3, range=0..1)

# ----
# 單點重新刷新
toggle_3 = BooleanToggle(True)

# ----
# 建築類型
list = ValueList({"圍合式": 0, "混合式": 1, "單點式": 2}, selected="混合式")

# ----
# 容積率
number_slider_11 = Slider(6, range=0..10)

# ----
# 樓地板比-大樓/總樓地板
number_slider_12 = Slider(0.4, range=0.2..0.8)

crv_2 = Curve(crv)
equals = Equality(FirstNumber=list, SecondNumber="0")  # -> Equality, Inequality
equals_2 = Equality(FirstNumber=list, SecondNumber="1")  # -> Equality, Inequality
# 已達指定面積無須再分割
nn_2 = Panel("圍合式/混和式")
equals_3 = Equality(FirstNumber=list, SecondNumber="1")  # -> Equality, Inequality
or = GateOr(A=equals.Equality, B=equals_2.Equality)
grouplock_3 = GroupLock(active=equals_3.Equality, nickName="混和式大樓group")  # -> out; inputs active: Boolean, nickName: String; same code as grouplock
grouplock_4 = GroupLock(active=or, nickName=nn_2)  # -> out; inputs active: Boolean, nickName: String; same code as grouplock
area = Area(Geometry=crv_2)  # -> Area, Centroid
pl = PlaneNormal(Origin=area.Centroid, ZAxis=Vector(0, 0, 1))
rotate = Rotate(Geometry=crv_2, Angle=degrees(random), Plane=pl)  # -> Geometry, Transform
curve = Curve(rotate.Geometry)
panel_7 = Panel("15000")

# ----
# 說明：基地分割街廓數量
area_2 = Area(Geometry=curve)  # -> Area, Centroid
division = Division(A=area_2.Area, B="25000")

construct_domain_4 = ConstructDomain(DomainStart=Slider(5, range=0..10), DomainEnd=Slider(10, range=0..10))
number_slider_13 = Slider(7, range=0..10)
random_4 = Random(Range=construct_domain_4, Number=1, Seed=addition)
addition_2 = Addition(A=random_4, B="7")
number_slider_14 = Slider(7, range=0..10)
addition_3 = Addition(A=number_slider_14, B="7")

# ----
# 三角的比例
number_slider_15 = Slider(0.6, range=0..1)

neg = Negative(Value="6")
neg_2 = Negative(Value="6")
neg_3 = Negative(Value="6")
neg_4 = Negative(Value="6")
neg_5 = Negative(Value="6")
neg_6 = Negative(Value="6")

# ----
# 大樓長寬
num = Number(Slider(19, range=10..30))
num_2 = Number(number_slider_7)

galapagos = Galapagos(gene=[number_slider_11, number_slider_10])
dom = ConstructDomain(DomainStart="-0.05", DomainEnd="0.05")

# ----
# 街廓過小的篩選
number_slider_16 = Slider(1849, range=0..10000)

dom_2 = ConstructDomain(DomainStart="-0.05", DomainEnd="0.05")

# ----
# 樓地板比-大樓/總樓地板
num_3 = Number(number_slider_12)

panel_8 = Panel(random_3)
crv_3 = Curve(crv_2)
area_3 = Area(Geometry=crv_3)  # -> Area, Centroid
multiplication = Multiplication(A=panel_8, B=area_3.Area)
subtraction = Subtraction(A="1", B=num_3)
multiplication_2 = Multiplication(A=multiplication, B=num_3)

# ----
# 總樓地板面積
panel_9 = Panel(multiplication)

multiplication_3 = Multiplication(A=multiplication, B=subtraction)

# ----
# 總底層面積
panel_10 = Panel(multiplication_3)

# ----
# 總大樓面積
panel_11 = Panel(multiplication_2)

crv_4 = Curve()
number_slider_17 = Slider(10000, range=0..10000)
panel_12 = Panel("1")
X = UnitX(Factor=Slider(0, range=0..1000))

panel_14 = Panel("https://energyplus-weather.s3.amazonaws.com/asia_wmo_region_2/TWN/TWN_Taipei.466960_IWEC/TWN_Taipei.466960_IWEC.zip")
epw_stat = Ladybug_OpenEPWAndSTATWeatherFiles(weatherFileURL=panel_14)  # -> epwFile, statFile; plug-in component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

panel_15 = Panel("0.35")  # disabled
panel_16 = Panel("0.35")  # disabled
panel_17 = Panel("0.15")  # disabled
panel_18 = Panel("0.15")  # disabled
construct_domain_5 = ConstructDomain(DomainStart=panel_17, DomainEnd=panel_15)  # disabled
construct_domain_6 = ConstructDomain(DomainStart=panel_18, DomainEnd=panel_16)  # disabled
ladybug = Ladybug_Ladybug()  # -> Vviiiiiiiiiizzz; plug-in component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
random_5 = Random(Range=construct_domain_5, Number=1, Seed=expr("x+100", addition))  # disabled
random_6 = Random(Range=construct_domain_6, Number=1, Seed=addition)  # disabled
panel_19 = Panel("1")  # disabled
subtraction_2 = Subtraction(A=panel_19, B=random_6, C=random_5)  # disabled
importepw = Ladybug_ImportEpw(epwFile=epw_stat.epwFile)  # -> readMe, latitude, location, dryBulbTemperature, dewPointTemperature, relativeHumidity, windSpeed, windDirection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; plug-in component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
ratio1 = Slider(0.3, range=0.15..0.35)  # disabled
ratio2 = Slider(0.3, range=0.15..0.35)  # disabled

number_slider_18 = Slider(1, range=0..10)
number_slider_19 = Slider(8, range=0..10)
analysisperiod = Ladybug_AnalysisPeriod(
    fromMonth=number_slider_18,
    fromDay=number_slider_19,
    fromHour=Slider(6, range=0..10),
    toMonth=number_slider_18,
    toDay=number_slider_19,
    toHour=Slider(19, range=0..100))  # -> readMe, analysisPeriod; plug-in component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

area_4 = Area(Geometry=crv)  # -> Area, Centroid

# ----
# Construction Set
bldg_vintage = Dragonfly_BldgAge({"ASHRAE 90.1 2013  |  IECC 2015": "2013", "ASHRAE 90.1 2010  |  IECC 2012": "2010", "ASHRAE 90.1 2007  |  IECC 2009": "2007", "ASHRAE 90.1 2004  |  IECC 2006": "2004", "1980-2004 (CBECS)": "1980_2004", "Pre-1980 (CBECS)": "pre_1980"}, selected="ASHRAE 90.1 2010  |  IECC 2012")  # disabled
constr_type = Dragonfly_BldgAge({"SteelFramed", "WoodFramed", "Mass", "Metal Building"}, selected="SteelFramed")  # disabled
climate_zone = Dragonfly_BldgAge({"1 - Very Hot": "1", "2 - Hot": "2", "3 - Warm": "3", "4 - Mixed": "4", "5 - Cool": "5", "6 - Cold": "6", "7 - Very Cold": "7", "8 - Subarctic": "8"}, selected="2 - Hot")  # disabled
constrsetclimate = HBConstructionSetByClimate(climate_zone=climate_zone, vintage=bldg_vintage, constr_type=constr_type)  # -> constr_set; disabled; plug-in component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

scale = Scale(Geometry=crv, Center=area_4.Centroid, Factor=Slider(1.7, range=0..10))  # -> Geometry, Transform
boundary = BoundarySurfaces(Edges=scale.Geometry)
entwine = Entwine(Branch00=analysisperiod.analysisPeriod, FlattenInputs=True)
srf = Surface(boundary)
brep = Brep(srf)
area_5 = Area(Geometry=brep)  # -> Area, Centroid
pt = Point(area_5.Centroid)
sunpath = Ladybug_SunPath(
    location=importepw.location,
    hour=12,
    day=21,
    month=12,
    timeStep=1,
    analysisPeriod=entwine,
    centerPt=pt,
    sunPathScale=Slider(2, range=0..10),
    sunScale=Slider(2, range=0..10),
    dailyOrAnnualSunPath=True)  # -> readMe, flatten(sunVectors), sunAltitudes, sunAzimuths, port, sunSpheresMesh, sunPathCrvs, compassCrvs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; plug-in component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
custom_mesh_settings = SettingsCustom(
    StitchSeams=True,
    SimplePlanes=False,
    Refine=True,
    MinCount=Slider(1000, range=0..1000),
    MaxCount=400,
    AspectRatio=20,
    MaxDistance=0,
    MaxAngle=20,
    MinEdge=0,
    MaxEdge=0)

# ----
# Full Bldg Small Office ProgramType
panel_20 = Panel("2013::LargeOffice::OpenOffice")  # disabled
panel_21 = Panel("LargeOfficeBuilding")  # disabled
panel_22 = Panel("1")  # disabled
blendprograms = HBBlendProgramTypes(name=panel_21, programs=panel_20, ratios=panel_22)  # -> program; disabled; plug-in component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

custom_mesh_settings_2 = SettingsCustom(
    StitchSeams=True,
    SimplePlanes=False,
    Refine=True,
    MinCount=Slider(10, range=0..100),
    MaxCount=400,
    AspectRatio=20,
    MaxDistance=0,
    MaxAngle=20,
    MinEdge=0,
    MaxEdge=0)
panel_23 = Panel("https://energyplus-weather.s3.amazonaws.com/asia_wmo_region_2/TWN/TWN_Taipei.466960_IWEC/TWN_Taipei.466960_IWEC.zip")
ladybug_2 = Ladybug_Ladybug()  # -> Vviiiiiiiiiizzz; plug-in component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
mesh = MeshBrep(Brep=brep, Settings=custom_mesh_settings)
legendpar = Ladybug_LegendParameters(legendScale=Slider(0.7, range=0..1))  # -> legendPar; plug-in component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
entwine_2 = Entwine(Branch00=mesh, FlattenInputs=True)
panel_24 = Panel(ladybug_2)
epw_stat_2 = Ladybug_OpenEPWAndSTATWeatherFiles(weatherFileURL=panel_23)  # -> epwFile, statFile; plug-in component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
panel_25 = Panel(epw_stat_2.epwFile)
hb_building_programs = HBBuildingPrograms({"LargeOffice", "MediumOffice", "SmallOffice", "MidriseApartment", "HighriseApartment", "Retail", "StripMall", "PrimarySchool", "SecondarySchool", "SmallHotel", "LargeHotel", "Hospital", "Outpatient", "Laboratory", "Warehouse", "SuperMarket", "FullServiceRestaurant", "QuickServiceRestaurant", "Courthouse", "LargeDataCenterHighITE", "LargeDataCenterLowITE", "SmallDataCenterHighITE", "SmallDataCenterLowITE"}, selected="Retail")  # disabled
gencumulativeskymtx = Ladybug_GenCumulativeSkyMtx(epwFile=epw_stat_2.epwFile, skyDensity=0, useOldRes=True, runIt=Toggle(True))  # -> readMe, cumulativeSkyMtx; plug-in component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
boundary_2 = BoundarySurfaces(Edges=crv_2)
Z = UnitZ(Factor=Slider(170, range=0..1000))
extr = Extrude(Base=boundary_2, Direction=Z)
debox = DeconstructBox(Box=extr)  # -> Plane, X, Y, Z
number_slider_20 = Slider(6, range=0..10)
selectskymtx = Ladybug_selectSkyMtx(cumulativeSkyMtx=gencumulativeskymtx.cumulativeSkyMtx, removeDiffuse=False, removeDirect=False)  # -> readMe, selectedSkyMtx; plug-in component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
number_slider_21 = Slider(11, range=0..100)
dedomain = DeconstructDomain(Domain=debox.X)  # -> Start, End
dedomain_2 = DeconstructDomain(Domain=debox.Y)  # -> Start, End
dedomain_3 = DeconstructDomain(Domain=debox.Z)  # -> Start, End
subtraction_3 = Subtraction(A=dedomain.End, B=dedomain.Start)
subtraction_4 = Subtraction(A=dedomain_2.End, B=dedomain_2.Start)
subtraction_5 = Subtraction(A=dedomain_3.End, B=dedomain_3.Start)
division_2 = Division(A=subtraction_5, B=number_slider_21)
division_3 = Division(A=subtraction_3, B=number_slider_21)
division_4 = Division(A=subtraction_4, B=number_slider_21)
toggle_4 = BooleanToggle(True)
Z_2 = UnitZ(Factor=1)
cpopingeo = CordiantePopulateInGeometry(Geometry=extr, XCount=division_3, YCount=division_4, ZCount=division_2)
multiplication_4 = Multiplication(A="29", B="35", C="15")
move = Move(Geometry=cpopingeo, Motion=Z_2)  # -> Geometry, Transform
panel_26 = Panel(multiplication_4)
points = PointList(Points=move.Geometry)
path = FilePath("D:\00Dissertation_Discuss\file\third_test\testttt_merge.xlsx")
path_2 = FilePath("D:\00Dissertation_Discuss\file\third_test\input to cpython.xlsx")
readxl = ReadExcelSheet(Run=Toggle(False), FilePath=path, Worksheet="1", Listen=False)  # -> UserMessages, Columns, Rows
lng_2 = ListLength(List=move.Geometry)
readxl_2 = ReadExcelSheet(Run=Toggle(True), FilePath=path_2, Worksheet="1", Listen=False)  # -> UserMessages, Columns, Rows
repeat = RepeatData(Data="0", Length=lng_2)
tstat_2 = TreeStatistics(Tree=readxl.Rows)  # -> Paths, Length, Count

# ---- group: 方塊組別
number_slider_22 = Slider(30, range=0..200)

# ----
tstat_3 = TreeStatistics(Tree=readxl_2.Rows)  # -> Paths, Length, Count
split = SplitList(List=tstat_2.Paths, Index="1")  # -> ListA, ListB
division_5 = Division(A=number_slider_21, B="4")
branch = TreeBranch(Tree=readxl.Rows, Path=split.ListB, MaintainPaths=True)
tstat_4 = TreeStatistics(Tree=branch)  # -> Paths, Length, Count
cull_i = CullIndex(List=tstat_3.Paths, Indices="0", Wrap=True)
neg_7 = Negative(Value=division_5)
item = ListItem(List=tstat_4.Paths, Index=number_slider_22, Wrap=True)
branch_2 = TreeBranch(Tree=readxl_2.Rows, Path=cull_i, MaintainPaths=True)
rectangle = Rectangle(Plane=PlaneXY(0, 0, 0), XSize=subtraction_3, YSize=subtraction_4, Radius=0)  # -> Rectangle, Length
dom_3 = ConstructDomain(DomainStart=neg_7, DomainEnd=division_5)
pt_2 = Point(move.Geometry)
branch_3 = TreeBranch(Tree=branch, Path=item, MaintainPaths=True)
area_6 = Area(Geometry=boundary_2)  # -> Area, Centroid
area_7 = Area(Geometry=rectangle.Rectangle)  # -> Area, Centroid
split_2 = SplitList(List=reverse(branch_2), Index="3")  # -> ListA, reverse(simplify(ListB))
cull_i_2 = CullIndex(List=branch_3, Indices="0", Wrap=True)  # -> reverse(List)
orient = Orient(Geometry=rectangle.Rectangle, Source=area_7.Centroid, Target=area_6.Centroid)  # -> Geometry, Transform
tstat_5 = TreeStatistics(Tree=split_2.ListB)  # -> Paths, Length, Count
split_3 = SplitList(List=cull_i_2, Index="4")  # -> ListA, reverse(ListB)
sdivide = DivideSurface(Surface=orient.Geometry, UCount=expr("x-1", division_3), VCount=expr("x-1", division_4))  # -> flatten(Points), Normals, Parameters
series = Series(Start=0, Step=Slider(12.13, range=11..13), Count=division_2)
panel_27 = Panel("28,34,15")
Z_3 = UnitZ(Factor=series)  # -> graft(UnitVector)
dispatch = Dispatch(List=pt_2, DispatchPattern=split_3.ListB)  # -> ListA, ListB
move_2 = Move(Geometry=sdivide.Points, Motion=Z_3)  # -> flatten(Geometry), Transform
multiplication_5 = Multiplication(A=Slider(29, range=0..100), B=Slider(35, range=0..100), C=Slider(15, range=0..100))
cull_i_3 = CullIndex(List=branch, Indices="0", Wrap=True)  # -> reverse(List)
pt_3 = Point(dispatch.ListA)
panel_28 = Panel(multiplication_5)

# ---- group: new_Grid
pt_4 = Point(move_2.Geometry)

# ----
lng_3 = ListLength(List=pt_4)
box = CenterBox(Base=pt_3, X=dom_3, Y=dom_3, Z=dom_3)
Z_4 = UnitZ(Factor="5")
cp = ClosestPoint(Point=pt_2, Cloud=pt_4)  # -> ClosestPoint, CPIndex, Distance
split_4 = SplitList(List=cull_i_3, Index="4")  # -> ListA, reverse(simplify(ListB))
item_2 = ListItem(List=tstat_5.Paths, Index=Slider(3, range=0..9), Wrap=True)
branch_4 = TreeBranch(Tree=split_2.ListB, Path=item_2, MaintainPaths=True)
cull_i_4 = CullIndex(List=branch_4, Indices="0", Wrap=True)
panel_29 = Panel(branch_4)
gh_cpython = GH_CPython(input="0", x=cull_i_4)  # -> output, reload_result_batch, average_sun_hour, radiation, visibility; inputs input: list, x: list
#   port input: [required] - [type = int] - [default = None] Descripe your input here * bullet point. * bullet point
#   port output: indicate your output description here. refers to a new line.
# ---------- gh_cpython: Python ----------
import tensorflow as tf
import matplotlib.pyplot as plt
import numpy as np
import pandas as pd


print(np.__version__)
print(pd.__version__)

shape = 15, 29, 35, 3

def array_to_color(array, cmap="Oranges"):
    s_m = plt.cm.ScalarMappable(cmap=cmap)
    return s_m.to_rgba(array)[:,:-1]

def rgb_data_transform(data):
    data_t = []
    for i in range(data.shape[0]):
        data_t.append(array_to_color(data[i]).reshape(shape))
    return np.asarray(data_t, dtype=np.float32)


data_predict = pd.DataFrame(x).transpose()
data_predict = data_predict.to_numpy()
pd_data_predict = pd.DataFrame(data_predict)

data_predict = rgb_data_transform(data_predict)

reload_model = tf.keras.models.load_model("D:/00Dissertation_Discuss/file/third_test/keras_model.h5")
reload_model.summary()

reload_result_batch = reload_model.predict(data_predict)
average_sun_hour = reload_result_batch[0][0]
radiation = reload_result_batch[0][1]
visibility = reload_result_batch[0][2]
# ---------- end gh_cpython ----------

# ----
# 格點總數
panel_30 = Panel(lng_3)

repeat_2 = RepeatData(Data="0", Length=lng_3)
move_3 = Move(Geometry=box, Motion=Z_4)  # -> Geometry, Transform
panel_31 = Panel(gh_cpython.reload_result_batch)
panel_32 = Panel(gh_cpython.average_sun_hour)
panel_33 = Panel(gh_cpython.radiation)
panel_34 = Panel(gh_cpython.visibility)
replace = ReplaceItems(List=repeat_2, Item=split_4.ListB, Indices=cp.CPIndex, Wrap=False)

# ----
# Simulation Parameters
number_slider_23 = Slider(1, range=0..1)  # disabled
toggle_5 = BooleanToggle(True)  # disabled
panel_35 = Panel("Monthly")  # disabled
simoutput = HBSimulationOutput(zone_energy_use=toggle_5, report_frequency=panel_35)  # -> report, sim_output; disabled; plug-in component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
shadowcalc = HBShadowCalculation(solar_dist=number_slider_23)  # -> shadow_calc; disabled; plug-in component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
panel_36 = Panel("1")  # disabled
simpar = HBSimulationParameter(output=simoutput.sim_output, timestep=panel_36, shadow_calc=shadowcalc)  # -> sim_par; disabled; plug-in component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

# ---- group: 方塊組別
number_slider_24 = Slider(70, range=0..200)

# ---- group: 顯示csv data
brep_2 = Brep(move_3.Geometry)

# ----
# Download EPW File
panel_37 = Panel("https://energyplus-weather.s3.amazonaws.com/asia_wmo_region_2/CHN/CHN_Shanghai.Shanghai.583620_CSWD/CHN_Shanghai.Shanghai.583620_CSWD.zip")  # disabled
downloadepw = LBDownloadWeather(weather_URL=panel_37)  # -> epw_file, stat_file, ddy_file; disabled; plug-in component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

tstat_6 = TreeStatistics(Tree=replace)  # -> Paths, Length, Count
toggle_6 = BooleanToggle(True)  # disabled
item_3 = ListItem(List=tstat_6.Paths, Index=number_slider_24, Wrap=True)
epwmap = LBEPWmap(epw_map=toggle_6)  # -> report; disabled; plug-in component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
branch_5 = TreeBranch(Tree=replace, Path=item_3, MaintainPaths=True)
dispatch_2 = Dispatch(List=pt_4, DispatchPattern=branch_5)  # -> ListA, ListB
cull_i_5 = CullIndex(List=split_4.ListA, Indices="0", Wrap=True)  # -> reverse(List)
pt_5 = Point(dispatch_2.ListA)
int = Integer(addition)
bool = Boolean(and_2)  # disabled
tstat_7 = TreeStatistics(Tree=cull_i_5)  # -> Paths, Length, Count
tstat_8 = TreeStatistics(Tree=replace)  # -> Paths, Length, Count
panel_38 = Panel(cull_i_5)
path_3 = ConstructPath(Indices=int)
replace_2 = ReplacePaths(Data=number_slider, Search=tstat.Paths, Replace=path_3)
datarec_boolean = DataRecBoolean(d=replace_2, reset=Toggle(False))  # -> out, A; inputs d: tree
# ---------- datarec_boolean: VB ----------
    If reset = True Then
      out_tree.clear
      Else 
      For Each p As GH_Path In d.Paths
        Dim out_list As List(Of Object) = d.Branch(p)
        out_tree.AddRange(out_list, New GH_Path(p))
      Next
      
    End If

    A = out_tree
# ---------- datarec_boolean: VB additional code ----------
  Dim out_tree As New DataTree(Of Object)
# ---------- end datarec_boolean ----------
lng_4 = ListLength(List=datarec_boolean.A)
panel_39 = Panel(datarec_boolean.A)
replace_3 = ReplacePaths(Data=cull_i_5, Search=tstat_7.Paths, Replace=tstat_8.Paths)
path_4 = FilePath("C:\Users\kevin\Desktop\CHN_Shanghai.Shanghai.583670_IWEC.epw")  # disabled
lng_5 = ListLength(List=cpopingeo)
merge = Merge(Data1=simplify(replace), Data2=simplify(replace_3))
split_5 = SplitList(List=reverse(merge), Index=Slider(16100, range=0..100000))  # -> reverse(simplify(ListA)), ListB
flip = FlipMatrix(Data=merge)
bang = ExplodeTree(Data=merge)
panel_40 = Panel(flip)
lng_6 = ListLength(List=flatten(bang))
subtraction_6 = Subtraction(A=lng_6, B="3")
series_2 = Series(Start=0, Step=1, Count=subtraction_6)
repeat_3 = RepeatData(Data="id_", Length=subtraction_6)
merge_2 = Merge(Data1=graft(repeat_3), Data2=graft(series_2))
bool_2 = Boolean(not)  # disabled
join = TextJoin(Text=merge_2)  # -> flatten(Result)
panel_41 = Panel(join)
entwine_3 = Entwine(Branch00=panel_41, Branch01="average_sun", Branch02="total_radiation", Branch03="visibility", FlattenInputs=True)  # -> flatten(Result)
# 朝向
datarec_boolean_2 = DataRecBoolean(d=random, reset=bool_2)  # -> out, A; inputs d: tree; disabled; same code as datarec_boolean
# 办公
datarec_boolean_3 = DataRecBoolean(d=random_5, reset=bool_2)  # -> out, A; inputs d: tree; disabled; same code as datarec_boolean
# 商业
datarec_boolean_4 = DataRecBoolean(d=random_6, reset=bool_2)  # -> out, A; inputs d: tree; disabled; same code as datarec_boolean
# 住宅
datarec_boolean_5 = DataRecBoolean(d=subtraction_2, reset=bool_2)  # -> out, A; inputs d: tree; disabled; same code as datarec_boolean
# Seed
datarec_boolean_6 = DataRecBoolean(d=addition, reset=bool_2)  # -> out, A; inputs d: tree; disabled; same code as datarec_boolean
tstat_9 = TreeStatistics(Tree=merge)  # -> Paths, Length, Count
series_3 = Series(Start=0, Step=1, Count=tstat_9.Count)
panel_42 = Panel(datarec_boolean_5.A)  # disabled
panel_43 = Panel(datarec_boolean_2.A)  # disabled
panel_44 = Panel(datarec_boolean_3.A)  # disabled
panel_45 = Panel(datarec_boolean_6.A)  # disabled
panel_46 = Panel(datarec_boolean_4.A)  # disabled
number_slider_25 = Slider(100, range=0..100)  # disabled

row_start = Slider(1, range=1..40)
column_start = Slider(1, range=1..40)
wo = WriteOptions(
    ClearDataOverwrite=True,
    SaveAfterWrite=False,
    CloseAfterWrite=False,
    ColumnStartPosition=column_start,
    RowStartPosition=row_start)  # -> UserMessages, WriteOptions
writexl = WriteToExcel(
    Run=Toggle(False),
    ExcelWorksheet="1",
    ColumnNames=entwine_3,
    RowNames=series_3,
    WriteOptions=wo.WriteOptions,
    ColumnnsOrRows=False,
    DataToWriteIntoColumns=flip)  # disabled

# ---- group: 每平方米的年发电量
number_slider_26 = Slider(187.5, range=0..1000)  # disabled

# ----
number_slider_27 = Slider(5, range=0..10)  # disabled
int_2 = Integer(addition)  # disabled
bool_3 = Boolean(not)  # disabled
panel_47 = Panel("0.01")  # disabled
# 朝向
cluster = Cluster_4(bool=bool_3, input=random, iter=int_2, batch=number_slider_27)  # disabled
# 办公
cluster_2 = Cluster_4(bool=bool_3, input=random_5, iter=int_2, batch=number_slider_27)  # disabled
# 商业
cluster_3 = Cluster_4(bool=bool_3, input=random_6, iter=int_2, batch=number_slider_27)  # disabled
# 住宅
cluster_4 = Cluster_4(bool=bool_3, input=subtraction_2, iter=int_2, batch=number_slider_27)  # disabled
# Seed
cluster_5 = Cluster_4(bool=bool_3, input=addition, iter=int_2, batch=number_slider_27)  # disabled

# ----
# 净能耗
# 总能耗
# 总光伏发电量
# 容积率
# 建筑密度
# 平均高度
# 高度标准差
# 平均街道高宽比H/W
# 体形系数
# 朝向
# 办公
# 商业
# 住宅
# Seed
num_4 = Number(Tree({0;0}: [3.880664, 5.709918, 3.99065, 5.843606, 4.111221], {0;1}: [6.001615, 4.275021, 2.521044, 4.423101, 2.762799], {0;2}: [4.685461, 2.912688, 4.811192, 2.920715, 4.8979], {0;3}: [3.261756, 5.156708, 3.508719, 5.249237, 3.616744], {0;4}: [5.238222, 3.595529, 5.620479, 3.99036, 5.704993], {0;5}: [4.088111, 5.934995, 4.283435, 5.991118, 4.445275]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))  # disabled
num_5 = Number(Tree({0;0}: [0.356449, 0.459454, 0.380286, 0.438038, 0.398636], {0;1}: [0.439321, 0.381091, 0.335134, 0.386725, 0.341086], {0;2}: [0.411082, 0.323938, 0.375587, 0.332706, 0.415928], {0;3}: [0.360023, 0.408569, 0.350464, 0.423095, 0.353518], {0;4}: [0.414951, 0.37311, 0.433166, 0.358908, 0.447194], {0;5}: [0.378407, 0.43471, 0.36945, 0.457809, 0.376204]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))  # disabled
num_6 = Number(Tree({0;0}: [0.1341381224, 0.1177637707, 0.1355169779, 0.1157459527, 0.1311551443], {0;1}: [0.1115859618, 0.1306810888, 0.1540643654, 0.1244822068, 0.1527166309], {0;2}: [0.1258518249, 0.1486144676, 0.1230828265, 0.1428056987, 0.1231141604], {0;3}: [0.1424278651, 0.1203244633, 0.1409391298, 0.1227887742, 0.1397928072], {0;4}: [0.1182271977, 0.1360059698, 0.1144617522, 0.1340205161, 0.1145607284], {0;5}: [0.1334570651, 0.1149467531, 0.1317519831, 0.1115484758, 0.1278051276]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))  # disabled
num_7 = Number(Tree({0;0}: [-23.41182715, -23.41182715, 70.6247294, -15.33871404, 78.69784251, -7.265600933], {0;1}: [86.77095562, 0.8075121747, -85.15593127, 8.880625283, -77.08281816], {0;2}: [16.95373839, -69.00970506, 25.0268515, -60.93659195, 33.09996461], {0;3}: [-52.86347884, 41.17307772, -44.79036573, 49.24619082, -36.71725262], {0;4}: [57.31930393, -28.64413951, 65.39241704, -20.57102641, 73.46553015], {0;5}: [-12.4979133, 81.53864326, -4.42480019, 89.61175636, 3.648312918]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))  # disabled
num_8 = Number(Tree({0;0}: [0.2724931425, 0.2724931425, 0.1769782053, 0.2814632682, 0.185948331, 0.2904333939], {0;1}: [0.1949184567, 0.2994035195, 0.2038885824, 0.3083736452, 0.212858708], {0;2}: [0.3173437709, 0.2218288337, 0.3263138966, 0.2307989594, 0.3352840222], {0;3}: [0.2397690851, 0.3442541479, 0.2487392107, 0.1532242736, 0.2577093364], {0;4}: [0.1621943993, 0.2666794621, 0.1711645249, 0.2756495878, 0.1801346506], {0;5}: [0.2846197135, 0.1891047763, 0.2935898391, 0.198074902, 0.3025599648]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))  # disabled
num_9 = Number(Tree({0;0}: [0.2239868587, 0.2239868587, 0.3284719216, 0.2329569844, 0.3374420472, 0.2419271101], {0;1}: [0.3464121729, 0.2508972357, 0.1553822986, 0.2598673614, 0.1643524243], {0;2}: [0.2688374871, 0.1733225499, 0.2778076128, 0.1822926756, 0.2867777385], {0;3}: [0.1912628013, 0.2957478641, 0.200232927, 0.3047179898, 0.2092030526], {0;4}: [0.3136881155, 0.2181731783, 0.3226582412, 0.227143304, 0.3316283668], {0;5}: [0.2361134297, 0.3405984925, 0.2450835553, 0.3495686182, 0.254053681]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))  # disabled
num_10 = Number(Tree({0;0}: [0.5035199988, 0.5035199988, 0.4945498731, 0.4855797474, 0.4766096217, 0.4676394961], {0;1}: [0.4586693704, 0.4496992447, 0.640729119, 0.4317589934, 0.6227888677], {0;2}: [0.413818742, 0.6048486163, 0.3958784907, 0.586908365, 0.3779382393], {0;3}: [0.5689681136, 0.359997988, 0.5510278623, 0.5420577366, 0.5330876109], {0;4}: [0.5241174853, 0.5151473596, 0.5061772339, 0.4972071082, 0.4882369826], {0;5}: [0.4792668569, 0.4702967312, 0.4613266055, 0.4523564799, 0.4433863542]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))  # disabled
num_11 = Number(Tree({0;0}: [51, 51, 52, 53, 54, 55], {0;1}: [56, 57, 58, 59, 60], {0;2}: [61, 62, 63, 64, 65], {0;3}: [66, 67, 68, 69, 70], {0;4}: [71, 72, 73, 74, 75], {0;5}: [76, 77, 78, 79, 80]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))  # disabled
num_12 = Number(Tree({0;0}: [196626032.2, 300406402.9, 205680561.3, 305383695.9, 204326438.3], {0;1}: [318779119.1, 214386158.6, 123007340.5, 219840165.3, 136995381], {0;2}: [235329316.9, 144526665.2, 245225965.1, 142953125.3, 246612923], {0;3}: [162191412.3, 258398766, 180301097.7, 282233365.1, 183969285.7], {0;4}: [274118287.4, 180523866.5, 292759188.7, 203313713.1, 294446032.4], {0;5}: [210395535.3, 315257187.2, 220335997, 311951769.9, 227899776.2]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))  # disabled
num_13 = Number(Tree({0;0}: [226590000, 333830000, 235110000, 339230000, 235320000], {0;1}: [352160000, 245770000, 150450000, 250820000, 164350000], {0;2}: [267450000, 171340000, 276010000, 171570000, 278710000], {0;3}: [191690000, 290820000, 208690000, 313850000, 212820000], {0;4}: [307330000, 210320000, 325270000, 232860000, 327610000], {0;5}: [239650000, 348400000, 250870000, 345980000, 258710000]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))  # disabled
num_14 = Number(Tree({0;0}: [29965148.99, 33422038.6, 29431309.34, 33847990.37, 30993334.71], {0;1}: [33379641.54, 31383280.63, 27437944.42, 30980271.35, 27357708.39], {0;2}: [32122540.77, 26817755.55, 30788618.51, 28612481.26, 32099136.42], {0;3}: [29502813.82, 32424952.93, 28388936.65, 31617408.3, 28853176.73], {0;4}: [33214803.35, 29792921.9, 32513194, 29545850.72, 33165095.01], {0;5}: [29249898.83, 33139692.21, 30530018.65, 34023374.28, 30806084.86]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))  # disabled
num_15 = Number(Tree({0;0}: [46.09090909, 77.06666667, 52.69565217, 65.71428571, 49.62162162], {0;1}: [69.8028169, 48.45454545, 33.06329114, 51.0617284, 37.31506849], {0;2}: [54.47368421, 38.7012987, 56.6746988, 37.10344828, 59.11111111], {0;3}: [39.65853659, 57.17073171, 44.25, 68.84848485, 44.65822785], {0;4}: [57.57142857, 45.83783784, 65.13432836, 48.52380952, 67.93939394], {0;5}: [54.94117647, 68.37333333, 50.11235955, 69.17647059, 51.90361446]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))  # disabled
num_16 = Number(Tree({0;0}: [26.10452606, 53.03516653, 33.2017567, 37.42034211, 30.09116899], {0;1}: [38.73369524, 28.43449773, 16.77501289, 25.35493508, 20.33208997], {0;2}: [32.15074432, 21.83709755, 29.18867103, 17.81322928, 37.96034318], {0;3}: [22.98844859, 30.67047714, 24.01952331, 47.03327076, 25.27764113], {0;4}: [25.76832945, 27.1467618, 35.67552592, 27.21190049, 39.31222294], {0;5}: [33.4918262, 41.62139621, 29.82549931, 38.6906818, 27.37671795]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))  # disabled
num_17 = Number(Tree({0;0}: [3.364461296, 4.072516997, 3.724640499, 3.392212393, 3.399589823], {0;1}: [3.521729234, 3.220670694, 3.219682647, 3.295715183, 3.481655841], {0;2}: [3.417018789, 3.465955293, 3.457802478, 3.194543106, 3.51039302], {0;3}: [3.287579882, 3.307076494, 3.536704824, 3.881871618, 3.445810332], {0;4}: [3.165977997, 3.418525158, 3.495660161, 3.501712567, 3.560500206], {0;5}: [3.840517136, 3.500952238, 3.39648609, 3.462557741, 3.414108606]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))  # disabled

number = Number(num_12)  # disabled
number_2 = Number(num_13)  # disabled
number_3 = Number(num_14)  # disabled
number_4 = Number(num_4)  # disabled
number_5 = Number(num_5)  # disabled
number_6 = Number(num_15)  # disabled
number_7 = Number(num_16)  # disabled
number_8 = Number(num_17)  # disabled
number_9 = Number(num_6)  # disabled
number_10 = Number(num_7)  # disabled
number_11 = Number(num_8)  # disabled
number_12 = Number(num_9)  # disabled
number_13 = Number(num_10)  # disabled
number_14 = Number(num_11)  # disabled

# ----
# 產生數據樹
toggle_7 = BooleanToggle(True)
int_3 = Integer(division)
loop_start = LoopStart(N="8", T=[toggle_7, addition, random], D0=int_3)  # -> port, Counter, Data, Data_2
panel_48 = Panel(loop_start.Counter)

# ----
# 說明：使用random隨機分配切割比例，
# 不同迭代切換不同隨機數
number_slider_28 = Slider(0.3, range=0..1)
subtraction_7 = Subtraction(A="1", B=number_slider_28)
dom_4 = ConstructDomain(DomainStart=number_slider_28, DomainEnd=subtraction_7)
addition_4 = Addition(A="8", B="1")
random_7 = Random(Range=dom_4, Number=addition_4, Seed=addition)
item_4 = ListItem(List=random_7, Index=loop_start.Counter, Wrap=True)

remap = RemapNumbers(Value=item_4, Source=Domain(0, 1), Target=loop_start.Data)  # -> Mapped, Clipped
int_4 = Integer(remap.Mapped)
subtraction_8 = Subtraction(A=loop_start.Data, B=int_4)
panel_49 = Panel(int_4)
panel_50 = Panel(subtraction_8)
merge_3 = Merge(Data1=int_4, Data2=subtraction_8)  # -> graft(Result)

# ----
# 說明：數據樹結果為1時，停止分割
flatten = FlattenTree(Tree=merge_3, Path="{0}")
bnd = Bounds(Numbers=flatten)
dedomain_4 = DeconstructDomain(Domain=bnd)  # -> Start, End
equals_4 = Equality(FirstNumber=dedomain_4.End, SecondNumber="1")  # -> Equality, Inequality

loop_end = LoopEnd(
    port=loop_start.port,
    Exit=equals_4.Equality,
    Data=merge_3,
    Data_2=loop_start.Counter,
    TimeOutVal=0,
    pausedState=False,
    state="Output last")  # -> D0, D1
panel_51 = Panel(loop_end.D1)
panel_52 = Panel(bnd)
panel_53 = Panel(dedomain_4.End)

panel_54 = Panel(loop_end.D1)
loop_start_2 = LoopStart(Repeat=panel_54, Trigger=[addition, toggle_7, Toggle(False)], Data=curve)  # -> port, Counter, Data

# ----
# step1：根據迭代數提取數據樹的比例
subtraction_9 = Subtraction(A=panel_54, B=loop_start_2.Counter)
neg_8 = Negative(Value=subtraction_9)
shift = ShiftPaths(Data=loop_end.D0, Offset=neg_8)
ma = MassAddition(Input=shift)  # -> Result, PartialResults
shift_2 = ShiftPaths(Data=ma.Result, Offset=-1)
ma_2 = MassAddition(Input=shift_2)  # -> Result, PartialResults

brep_3 = Brep(loop_start_2.Data)
unflatten = UnflattenTree(Tree=brep_3, Guide=ma_2.Result)
cluster_6 = Cluster(obj=unflatten, plane=pl)  # -> brep, edge
len = Length(Curve=cluster_6.edge)
sort = SortList(Keys=len, ValuesA=cluster_6.edge)  # -> Keys, reverse(ValuesA)
item_5 = ListItem(List=sort.ValuesA, Index=0, Wrap=True)

# ----
# step2：提取可能的分割線，後續會選擇最
# 接近分割比例的分割線，距離越小越精準
item_6 = ListItem(List=sort.ValuesA, Index=0, Wrap=True)  # -> Item, Item1
number_slider_29 = Slider(10, range=0..100)
flip_2 = FlipCurve(Curve=item_6.Item, Guide=item_6.Item1)  # -> Curve, Flag
divlength = DivideLength(Curve=item_6.Item1, Length=number_slider_29)  # -> Points, Tangents, Parameters
divlength_2 = DivideLength(Curve=flip_2.Curve, Length=number_slider_29)  # -> Points, Tangents, Parameters
ln = Line(StartPoint=divlength_2.Points, EndPoint=divlength.Points)  # -> simplify(Line)

# ----
# 說明：使用shift path與mass addition可進入前
# 一串分割比例
panel_55 = Panel(loop_end.D0)
shift_3 = ShiftPaths(Data=panel_55, Offset=-1)
ma_3 = MassAddition(Input=shift_3)  # -> Result, PartialResults
panel_56 = Panel(ma_3.Result)

# ----
# 說明：創造符合迭代的數據形式，方便
# 資料結構的配對與整理
lng_7 = ListLength(List=ln)
unflatten_2 = UnflattenTree(Tree=lng_7, Guide=unflatten)
series_4 = Series(Start=0, Step=1, Count=unflatten_2)  # -> graft(Series)

# ----
# step3：用可能的分割線去分割面，因應
# 後續的面積比例排序，挑選接近比例的
# 分割組別
lng_8 = ListLength(List=ln)
unflatten_3 = UnflattenTree(Tree=lng_8, Guide=unflatten)
unflatten_4 = UnflattenTree(Tree=ln, Guide=series_4)
repeat_4 = RepeatData(Data=unflatten, Length=unflatten_3)  # -> graft(Data)
srfsplit = SurfaceSplit(Surface=repeat_4, Curves=unflatten_4)

# ----
# step4：區分左右塊，因為srf split分割時，左右
# 塊的順序會錯亂
area_8 = Area(Geometry=srfsplit)  # -> Area, Centroid
crv_cp = CurveClosestPoint(Point=area_8.Centroid, Curve=unflatten_4)  # -> Point, Parameter, Distance
vec2pt = Vector2Pt(PointA=area_8.Centroid, PointB=crv_cp.Point, Unitize=False)  # -> Vector, Length
vec = Vector(item_5)
shift_4 = ShiftPaths(Data=vec2pt.Vector, Offset="-2")
shift_5 = ShiftPaths(Data=vec, Offset=-1)
lng_9 = ListLength(List=shift_4)
repeat_5 = RepeatData(Data=shift_5, Length=lng_9)  # -> graft(Data)
unflatten_5 = UnflattenTree(Tree=repeat_5, Guide=vec2pt.Vector)
dprod = DotProduct(VectorA=unflatten_5, VectorB=vec2pt.Vector, Unitize=invert(False))
equals_5 = Equality(FirstNumber=dprod, SecondNumber="-1")  # -> Equality, Inequality
dispatch_3 = Dispatch(List=srfsplit, DispatchPattern=equals_5.Equality)  # -> ListA, ListB

# ----
# step5：比較srf split後的兩塊面積的比例，
# 用sort list選出最接近數據樹的比例
area_9 = Area(Geometry=dispatch_3.ListA)  # -> Area, Centroid
area_10 = Area(Geometry=dispatch_3.ListB)  # -> Area, Centroid
shift_6 = ShiftPaths(Data=ma.Result, Offset=-1)
ma_4 = MassAddition(Input=area_9.Area)  # -> Result, PartialResults
ma_5 = MassAddition(Input=area_10.Area)  # -> Result, PartialResults
division_6 = Division(A=ma_4.Result, B=ma_5.Result)
item_7 = ListItem(List=shift_6, Index=0, Wrap=True)  # -> Item, Item1
shift_7 = ShiftPaths(Data=simplify(division_6), Offset=-1)
division_7 = Division(A=item_7.Item, B=item_7.Item1)
lng_10 = ListLength(List=shift_7)
shift_8 = ShiftPaths(Data=division_6, Offset=-1)
group = Group(Objects=unflatten_4)
shift_9 = ShiftPaths(Data=group, Offset=-1)

# ----
# 說明：從數據樹挑選出比例
panel_57 = Panel(shift_6)

# ----
# 如果比例為1:0，輸出0
panel_58 = Panel("0")
equals_6 = Equality(FirstNumber=item_7.Item1, SecondNumber=panel_58)  # -> Equality, Inequality
weave = Weave(Pattern=equals_6.Equality, Stream0=division_7, Stream1="0", NullGaps=False)

repeat_6 = RepeatData(Data=weave, Length=lng_10)  # -> simplify(graft(Data))
panel_59 = Panel(repeat_6)
subtraction_10 = Subtraction(A=shift_8, B=repeat_6)
abs = Absolute(Value=subtraction_10)
shift_10 = ShiftPaths(Data=abs, Offset="-2")
sort_2 = SortList(Keys=shift_10, ValuesA=shift_9)  # -> Keys, ValuesA
item_8 = ListItem(List=sort_2.ValuesA, Index=0, Wrap=True)
ungroup = Ungroup(Group=item_8)

# ----
# step6：一些微調，有些比例為0，也就是數據
# 樹的分割比例有0時，ex:1/0,2/0之類的，會使
# 切割線落於兩側，沒切到會使後續資料變成1
# 筆，切到會生成很小的區塊，會產生錯誤畸零
# 地，因此解決方法是，萬一切出畸零地時，替代
# 一塊完整的自身街廓給這組，不會切出畸零地，
# 但資料數目也會變成1筆，後續會報錯，與沒
# 有切到的狀況相同，資料數目會在後續解決
# 說明：目標街廓過小時的條件機制
srfsplit_2 = SurfaceSplit(Surface=unflatten, Curves=ungroup)
area_11 = Area(Geometry=srfsplit_2)  # -> Area, Centroid
srf_2 = Surface(unflatten)
tstat_10 = TreeStatistics(Tree=srfsplit_2)  # -> Paths, Length, Count
smaller_3 = SmallerThan(FirstNumber=area_11.Area, SecondNumber=Slider(10000, range=0..10000))  # -> SmallerThan, OrEqualTo
graft = GraftTree(Tree=srf_2, IncludeEmptyLists=True, IncludeNullItems=True)
graft_2 = GraftTree(Tree=graft, IncludeEmptyLists=True, IncludeNullItems=True)
ma_6 = MassAddition(Input=smaller_3.SmallerThan)  # -> Result, PartialResults
graft_3 = GraftTree(Tree=graft_2, IncludeEmptyLists=True, IncludeNullItems=True)
dispatch_4 = Dispatch(List=tstat_10.Paths, DispatchPattern=flatten(ma_6.Result))  # -> ListA, ListB
branch_6 = TreeBranch(Tree=graft_3, Path=dispatch_4.ListA, MaintainPaths=True)
branch_7 = TreeBranch(Tree=srfsplit_2, Path=dispatch_4.ListB, MaintainPaths=True)
merge_4 = Merge(Data1=branch_6, Data2=branch_7)

# ----
# 說明：如果是比例1/2，如何辨識哪一塊是2?且
# 在下一迭代會再被切一次呢?
# step7：分割的面塊沒有先後之分，會導致數據樹
# 的比例分配錯誤，因為只有兩塊將面塊按順序，
# 由大至小和由小至大排好，數據樹的兩筆，前一
# 筆除以後一筆，大於1者，面塊順序便是大至小
# ，反之，除以後小於1，面塊順序便是小至大
panel_60 = Panel(ma.Result)
brep_4 = Brep(merge_4)
shift_11 = ShiftPaths(Data=panel_60, Offset=-1)
area_12 = Area(Geometry=brep_4)  # -> Area, Centroid
item_9 = ListItem(List=shift_11, Index=0, Wrap=True)  # -> Item, Item1
division_8 = Division(A=item_9.Item, B=item_9.Item1)
sort_3 = SortList(Keys=area_12.Area, ValuesA=brep_4)  # -> Keys, ValuesA
sort_4 = SortList(Keys=area_12.Area, ValuesA=brep_4)  # -> Keys, reverse(ValuesA)
equals_7 = Equality(FirstNumber=item_9.Item1, SecondNumber="0")  # -> Equality, Inequality
weave_2 = Weave(Pattern=equals_7.Equality, Stream0=division_8, Stream1="0", NullGaps=False)
larger = LargerThan(FirstNumber=weave_2, SecondNumber="1")  # -> LargerThan, OrEqualTo
weave_3 = Weave(Pattern=larger.LargerThan, Stream0=sort_3.ValuesA, Stream1=sort_4.ValuesA, NullGaps=False)
panel_61 = Panel(larger.LargerThan)

panel_62 = Panel(branch_7)

# ----
# 數據筆數是1時，分配至A
lng_11 = ListLength(List=weave_3)
equals_8 = Equality(FirstNumber=lng_11, SecondNumber="1")  # -> Equality, Inequality
dispatch_5 = Dispatch(List=weave_3, DispatchPattern=equals_8.Equality)  # -> ListA, ListB

# ----
# step8：整理資料數目，資料數目務必變為2筆，
# 在step6時，會讓資料數目減為1筆，會導致下一
# 步驟的unflatten tree資料數目對不上而報錯，
# unflatten tree會將資料的名稱整理為數據樹的
# 形式，解決辦法是補同一個面給這一組，面重
# 複的話，後續再解決
clean = CleanTree(RemoveNulls=True, RemoveInvalid=True, RemoveEmpty=invert(False), Tree=dispatch_5.ListA)
clean_2 = CleanTree(RemoveNulls=True, RemoveInvalid=True, RemoveEmpty=invert(False), Tree=dispatch_5.ListB)
ins = InsertItems(List=clean, Item=clean, Indices="1", Wrap=True)
shift_12 = ShiftPaths(Data=ins, Offset=-1)
panel_63 = Panel(shift_12)
merge_5 = Merge(Data1=shift_12, Data2=clean_2)
unflatten_6 = UnflattenTree(Tree=merge_5, Guide=panel_60)

loop_end_2 = LoopEnd(port=loop_start_2.port, Exit=False, Data=unflatten_6, TimeOutVal=0, pausedState=False, state="Output last")

# ----
# 去蕪存菁，刪除重複面
# step9：在上一步驟時，會產生重複的面，在這
# 一步驟解決
flatten_2 = FlattenTree(Tree=loop_end_2, Path="{0}")
area_13 = Area(Geometry=flatten_2)  # -> Area, Centroid
cset = CreateSet(List=area_13.Centroid)  # -> Set, Map
mindex = MemberIndex(Set=area_13.Centroid, Member=cset.Set)  # -> Index, Count
item_10 = ListItem(List=mindex.Index, Index=0, Wrap=True)
panel_64 = Panel(mindex.Index)
item_11 = ListItem(List=flatten_2, Index=item_10, Wrap=True)

# ----
# 分割完成，若有旋轉，在這步轉回來
rotate_2 = Rotate(Geometry=item_11, Angle=expr("-x", degrees(random)), Plane=pl)  # -> Geometry, Transform

# ----
# 切割面積
area_14 = Area(Geometry=rotate_2.Geometry)  # -> flatten(Area), Centroid
group_2 = Group(Objects=flatten(rotate_2.Geometry))
crv_5 = Curve(rotate_2.Geometry)
preview = CustomPreview(Geometry=crv_5, Material=ColourSwatch(SwatchColor=RGB(0, 93, 255)))
roundd = RoundToDecimalPlace(NumberX=area_14.Area, DecimalPlace="0", RoundType=0)  # -> Rounded, Difference
tag = TextTag(Location=area_14.Centroid, Text=graft(roundd.Rounded), Colour=ColourSwatch(SwatchColor=RGB(255, 255, 255)))
panel_65 = Panel(area_14.Area)

# ---- group: 圍合式/混和式
# 判斷長方形街廓，比例差異過大者，
# 不適合做圍合式
rotate_3 = Rotate(Geometry=pl, Angle=expr("-x", degrees(random)), Plane=PlaneXY(0, 0, 0))  # -> Geometry, Transform
cluster_7 = Cluster(obj=rotate_2.Geometry, plane=rotate_3.Geometry)  # -> brep, edge
item_12 = ListItem(List=cluster_7.edge, Index=0, Wrap=True)  # -> Item, Item1
len_2 = Length(Curve=item_12.Item)
len_3 = Length(Curve=item_12.Item1)
merge_6 = Merge(Data1=len_2, Data2=len_3)
sort_5 = SortList(Keys=merge_6)  # -> Keys, ValuesA
item_13 = ListItem(List=sort_5.Keys, Index=0, Wrap=True)  # -> Item, Item1
division_9 = Division(A=item_13.Item1, B=item_13.Item)
larger_2 = LargerThan(FirstNumber=division_9, SecondNumber=Slider(2.3, range=1..5))  # -> LargerThan, OrEqualTo
dispatch_6 = Dispatch(List=rotate_2.Geometry, DispatchPattern=larger_2.LargerThan)  # -> ListA, ListB

# ----
# 長條式
srf_3 = Surface(dispatch_6.ListA)

# ----
# 圍合式
srf_4 = Surface(dispatch_6.ListB)

clean_3 = CleanTree(RemoveNulls=True, RemoveInvalid=True, RemoveEmpty=invert(False), Tree=dispatch_6.ListB)  # -> simplify(Tree)
polyoffset = PolylineOffset(
    Polylines=clean_3,
    Distance=random_4,
    Plane=Plane(origin=(0, 0, 0), x=(0, 0, 0), y=(0, 0, 0)),
    Tolerance=0.001,
    ClosedFillet=1,
    OpenFillet=1,
    Miter=2)  # -> Contour, Holes
polyoffset_2 = PolylineOffset(
    Polylines=clean_3,
    Distance=addition_2,
    Plane=Plane(origin=(0, 0, 0), x=(0, 0, 0), y=(0, 0, 0)),
    Tolerance=0.001,
    ClosedFillet=1,
    OpenFillet=1,
    Miter=2)  # -> Contour, Holes

# ----
# 街廓
fillet = Fillet(Curve=polyoffset.Holes, Radius=Slider(5, range=0..10))  # -> simplify(Curve)

# ----
# 說明:生成所有可能的建築深度
number_slider_30 = Slider(10, range=0..10)
crv_6 = Curve(simplify(polyoffset_2.Holes))
series_5 = Series(Start="10", Step="2", Count="30")
polyoffset_3 = PolylineOffset(
    Polylines=crv_6,
    Distance=series_5,
    Plane=Plane(origin=(0, 0, 0), x=(0, 0, 0), y=(0, 0, 0)),
    Tolerance=0.001,
    ClosedFillet=1,
    OpenFillet=1,
    Miter=2)  # -> Contour, Holes

# ----
# 說明:因為每個街廓可內退的深度數目不同，對
# 後續資料整理flip matrix會有影響，在此將所有
# 數量縮減至相同
crv_7 = Curve(simplify(polyoffset_3.Holes))
shift_13 = ShiftPaths(Data=crv_7, Offset=-1)
lng_12 = ListLength(List=shift_13)
bnd_2 = Bounds(Numbers=flatten(lng_12))
dedomain_5 = DeconstructDomain(Domain=bnd_2)  # -> Start, End
split_6 = SplitList(List=shift_13, Index=dedomain_5.Start)  # -> ListA, ListB
lng_13 = ListLength(List=split_6.ListA)

repeat_7 = RepeatData(Data=crv_6, Length=lng_13)  # -> simplify(graft(Data))

# ----
# 長條式
clean_4 = CleanTree(RemoveNulls=True, RemoveInvalid=True, RemoveEmpty=invert(False), Tree=srf_3)  # -> simplify(Tree)

area_15 = Area(Geometry=flatten(clean_3))  # -> Area, Centroid
unflatten_7 = UnflattenTree(Tree=split_6.ListA, Guide=repeat_7)
polyoffset_4 = PolylineOffset(
    Polylines=clean_4,
    Distance=number_slider_14,
    Plane=Plane(origin=(0, 0, 0), x=(0, 0, 0), y=(0, 0, 0)),
    Tolerance=0.001,
    ClosedFillet=1,
    OpenFillet=1,
    Miter=2)  # -> Contour, Holes

# ----
# 街廓
fillet_2 = Fillet(Curve=polyoffset_4.Holes, Radius=Slider(5, range=0..10))

polyoffset_5 = PolylineOffset(
    Polylines=clean_4,
    Distance=addition_3,
    Plane=Plane(origin=(0, 0, 0), x=(0, 0, 0), y=(0, 0, 0)),
    Tolerance=0.001,
    ClosedFillet=1,
    OpenFillet=1,
    Miter=2)  # -> Contour, Holes

# ----
# 說明:將長條街廓運用小徑分成三塊
explode = Explode(Curve=polyoffset_5.Holes, Recursive=True)  # -> Segments, Vertices
len_4 = Length(Curve=explode.Segments)
sort_6 = SortList(Keys=len_4, ValuesA=explode.Segments)  # -> Keys, ValuesA
item_14 = ListItem(List=reverse(sort_6.ValuesA), Index=0, Wrap=True)  # -> Item, Item1
divide = DivideCurve(Curve=item_14.Item, Count="3", Kinks=False)  # -> Points, Tangents, Parameters
item_15 = ListItem(List=divide.Points, Index=0, Wrap=True)  # -> Item, Item1, Item2, Item3
rotate_4 = Rotate(Geometry=item_14.Item, Angle=degrees("90"), Plane=[item_15.Item1, item_15.Item2])  # -> Geometry, Transform
ext = ExtendCurve(Curve=rotate_4.Geometry, Type=0, Start="100", End="100")
neg_9 = Negative(Value="6")
offset = OffsetCurve(Curve=graft(ext), Distance=[neg_9, "6"], Plane=PlaneXY(0, 0, 0), Corners=1)
shift_14 = ShiftPaths(Data=offset, Offset=-1)
end = EndPoints(Curve=shift_14)  # -> Start, End
pline = PolyLine(Vertices=end.End, Closed=False)
pline_2 = PolyLine(Vertices=end.Start, Closed=False)
join_2 = JoinCurves(Curves=[shift_14, pline_2, pline], Preserve=False)
shift_15 = ShiftPaths(Data=simplify(join_2), Offset=-1)

# ----
# 說明:選擇街廓最長的邊，以及相接的邊
crv_8 = Curve(polyoffset_5.Holes)
explode_2 = Explode(Curve=crv_8, Recursive=True)  # -> Segments, Vertices
len_5 = Length(Curve=explode_2.Segments)
sort_7 = SortList(Keys=len_5, ValuesA=explode_2.Segments)  # -> Keys, reverse(ValuesA)
midpt = CurveMiddle(Curve=explode_2.Segments)
item_16 = ListItem(List=sort_7.ValuesA, Index=0, Wrap=True)
midpt_2 = CurveMiddle(Curve=item_16)
cp_2 = ClosestPoint(Point=midpt_2, Cloud=midpt)  # -> ClosestPoint, CPIndex, Distance
shift_16 = ShiftList(List=explode_2.Segments, Shift=cp_2.CPIndex, Wrap=True)
item_17 = ListItem(List=shift_16, Index=0, Wrap=True)  # -> Item1, Item, Item1_2
join_3 = JoinCurves(Curves=[item_17.Item1_2, item_17.Item], Preserve=False)
join_4 = JoinCurves(Curves=[item_17.Item1, item_17.Item], Preserve=False)
len_6 = Length(Curve=[join_4, join_3])
sort_8 = SortList(Keys=len_6, ValuesA=[join_4, join_3])  # -> Keys, ValuesA
item_18 = ListItem(List=reverse(sort_8.ValuesA), Index=0, Wrap=True)  # -> simplify(Item)
ext_2 = ExtendCurve(Curve=item_18, Type=0, Start="50", End="50")

area_16 = Area(Geometry=flatten(clean_3))  # -> Area, Centroid
ma_7 = MassAddition(Input=area_16.Area)  # -> Result, PartialResults

# ----
# 說明:生成全部可能的深度
number_slider_31 = Slider(10, range=0..10)
series_6 = Series(Start="20", Step="5", Count=number_slider_31)
neg_10 = Negative(Value=series_6)
offcrv = OffsetCurve(Curve=ext_2, Plane=PlaneXY(0, 0, 0), Distance=neg_10, BothSides=0, Kinks=0, CapType=0)
offcrv_2 = OffsetCurve(Curve=ext_2, Plane=PlaneXY(0, 0, 0), Distance=series_6, BothSides=0, Kinks=0, CapType=0)
merge_7 = Merge(Data1=offcrv, Data2=offcrv_2)
len_7 = Length(Curve=merge_7)
sort_9 = SortList(Keys=len_7, ValuesA=merge_7)  # -> Keys, ValuesA
item_19 = ListItem(List=sort_9.ValuesA, Index=0, Wrap=True)

crv_9 = Curve(simplify(fillet_2))

# ----
# 路徑
runion = RegionUnion(Curves=shift_15)

tstat_11 = TreeStatistics(Tree=simplify(runion))  # -> Paths, Length, Count
dpath = DeconstructPath(Branch=tstat_11.Paths)
panel_66 = Panel(dpath)
item_20 = ListItem(List=dpath, Index=0, Wrap=True)
path_5 = ConstructPath(Indices=item_20)

# ----
# 街廓
branch_8 = TreeBranch(Tree=crv_9, Path=path_5, MaintainPaths=True)

# ----
# 若只有一個街廓如此，
# tree branch會報錯
lng_14 = ListLength(List=flatten(path_5))
# 外框
# 建築
# 可建範圍
panel_67 = Panel("1")
equals_9 = Equality(FirstNumber=lng_14, SecondNumber=panel_67)  # -> Equality, Inequality
# 生成不規則形中最大的矩形
# 可建造面積
weave_4 = Weave(Pattern=equals_9.Equality, Stream0=branch_8, Stream1=crv_9, NullGaps=False)

crv_10 = Curve(ext_2)
repeat_8 = RepeatData(Data=crv_10, Length=number_slider_31)  # -> simplify(graft(Data))
crv_11 = Curve(simplify(crv_8))
crv_12 = Curve(runion)
rdiff = RegionDifference(CurvesA=weave_4, CurvesB=runion)
rdiff_2 = RegionDifference(CurvesA=crv_11, CurvesB=crv_12)
crv_13 = Curve(crv_11)
rdiff_3 = RegionDifference(CurvesA=crv_13, CurvesB=runion)
crv_14 = Curve(fillet)
crv_15 = Curve(fillet)
crv_16 = Curve(fillet)
crv_17 = Curve(flatten(crv_5))
explode_3 = Explode(Curve=crv_17, Recursive=True)  # -> flatten(Segments), Vertices
mcx = MultipleCurves(Curves=explode_3.Segments)  # -> Points, IndexA, IndexB, ParamA, ParamB
clone = CloneStructure(List=mcx.ParamA, Structure=mcx.IndexA)
clone_2 = CloneStructure(List=mcx.ParamB, Structure=mcx.IndexB)
merge_8 = Merge(Data1=clone, Data2=clone_2)
shatter = Shatter(Curve=graft(explode_3.Segments), Parameters=merge_8)  # -> flatten(Segments)
dupln = RemoveDuplicateLines(Lines=shatter, Tolerance=0.01)
divlength_3 = DivideLength(Curve=dupln, Length=Slider(31, range=0..100))  # -> flatten(Points), Tangents, Parameters
duppt = RemoveDuplicatePts(Points=divlength_3.Points, Tolerance=0.01)

multiplication_6 = Multiplication(A=random_4, B="2")

# ----
# 說明:全部可能的深度建築與建地面積相除，取
# 最接近建蔽率的建築深度
merge_9 = Merge(Data1=repeat_7, Data2=unflatten_7)
boundary_3 = BoundarySurfaces(Edges=merge_9)
shift_17 = ShiftPaths(Data=boundary_3, Offset=-1)
flip_3 = FlipMatrix(Data=shift_17)
ma_8 = MassAddition(Input=area_15.Area)  # -> Result, PartialResults
area_17 = Area(Geometry=flip_3)  # -> Area, Centroid
item_21 = ListItem(List=flip_3, Index=0, Wrap=True)
ma_9 = MassAddition(Input=area_17.Area)  # -> Result, PartialResults
division_10 = Division(A=ma_9.Result, B=ma_8.Result)
panel_68 = Panel(ma_9.Result)
shift_18 = ShiftPaths(Data=boundary_3, Offset=-1)

# ----
# 回補面積
panel_69 = Panel("0")
subtraction_11 = Subtraction(A=division_10, B=panel_69)

subtraction_12 = Subtraction(A=subtraction_11, B=random_2)
abs_2 = Absolute(Value=subtraction_12)
shift_19 = ShiftPaths(Data=abs_2, Offset=-1)
panel_70 = Panel(abs_2)
sort_10 = SortList(Keys=shift_19, ValuesA=shift_18)  # -> Keys, ValuesA
item_22 = ListItem(List=sort_10.ValuesA, Index=0, Wrap=True)
flip_4 = FlipMatrix(Data=item_22)  # -> graft(Data)

# ----
# 可建地
unflatten_8 = UnflattenTree(Tree=flip_4, Guide=crv_6)

area_18 = Area(Geometry=flatten(unflatten_8))  # -> Area, Centroid

# ----
# 說明:圍合式建築需區分三角形與矩形，因為兩
# 者切分小路的方式不同
edges = BrepEdges(Brep=unflatten_8)  # -> Naked, Interior, NonManifold
join_5 = JoinCurves(Curves=edges.Naked, Preserve=False)
len_8 = Length(Curve=join_5)
sort_11 = SortList(Keys=len_8, ValuesA=join_5)  # -> Keys, ValuesA
item_23 = ListItem(List=sort_11.ValuesA, Index=0, Wrap=True)  # -> simplify(Item)
rotate_5 = Rotate(Geometry=pl, Angle=expr("-x", degrees(random)), Plane=PlaneXY(0, 0, 0))  # -> Geometry, Transform
crv_18 = Curve(item_23)
cluster_8 = Cluster(obj=item_23, plane=rotate_5.Geometry)  # -> brep, edge
join_6 = JoinCurves(Curves=cluster_8.edge, Preserve=False)
area_19 = Area(Geometry=join_6)  # -> simplify(Area), Centroid
area_20 = Area(Geometry=item_23)  # -> Area, Centroid
division_11 = Division(A=area_20.Area, B=area_19.Area)
panel_71 = Panel(division_11)
smaller_4 = SmallerThan(FirstNumber=division_11, SecondNumber=number_slider_15)  # -> SmallerThan, OrEqualTo

ma_10 = MassAddition(Input=area_18.Area)  # -> Result, PartialResults
division_12 = Division(A=ma_10.Result, B=ma_7.Result)
panel_72 = Panel(division_12)

# ----
# 判斷是否為三角地
dispatch_7 = Dispatch(List=unflatten_8, DispatchPattern=smaller_4.SmallerThan)  # -> ListA, ListB
dispatch_8 = Dispatch(List=item_23, DispatchPattern=smaller_4.SmallerThan)  # -> ListA, ListB

# ----
# 判斷是否為三角地是否在基地端點
# 說明:之所以區分三角地是否在基地頂點處，是
# 因為會影響判斷最長邊在何處，後續切分小路
# 會仰賴挑選最長邊去區分，一般直角三角形最
# 長邊為斜邊，位在頂點處的三角地因為最長邊
# 被截斷，會導致判別時，沒把斜邊視為最長，
# 導致劃分小路出現問題，基本上，未在頂點的
# 三角地帶多為三角形，在頂點的大多為四邊形
srf_5 = Surface(simplify(dispatch_6.ListB))
clean_5 = CleanTree(RemoveNulls=True, RemoveInvalid=True, RemoveEmpty=invert(False), Tree=srf_5)
dispatch_9 = Dispatch(List=clean_5, DispatchPattern=smaller_4.SmallerThan)  # -> ListA, ListB
clean_6 = CleanTree(RemoveNulls=True, RemoveInvalid=True, RemoveEmpty=invert(False), Tree=dispatch_9.ListA)
disc = Discontinuity(Curve=crv_2, Level=1)  # -> Points, Parameters
pull = PullPoint(Point=disc.Points, Geometry=clean_6, ClosestOnly=True)  # -> ClosestPoint, Distance
tstat_12 = TreeStatistics(Tree=clean_6)  # -> Paths, Length, Count
tstat_13 = TreeStatistics(Tree=pull.Distance)  # -> Paths, Length, Count
replace_4 = ReplacePaths(Data=pull.Distance, Search=tstat_13.Paths, Replace=tstat_12.Paths)
panel_73 = Panel(clean_6)
sort_12 = SortList(Keys=replace_4)  # -> Keys, ValuesA
item_24 = ListItem(List=sort_12.Keys, Index=0, Wrap=True)
srf_6 = Surface(dispatch_7.ListA)
crv_19 = Curve(dispatch_8.ListA)
clean_7 = CleanTree(RemoveNulls=True, RemoveInvalid=True, RemoveEmpty=invert(False), Tree=crv_19)
clean_8 = CleanTree(RemoveNulls=True, RemoveInvalid=True, RemoveEmpty=invert(False), Tree=srf_6)
dispatch_10 = Dispatch(List=clean_7, DispatchPattern=item_24)  # -> ListA, ListB
dispatch_11 = Dispatch(List=clean_8, DispatchPattern=item_24)  # -> ListA, ListB
clean_9 = CleanTree(RemoveNulls=True, RemoveInvalid=True, RemoveEmpty=invert(False), Tree=dispatch_10.ListB)
clean_10 = CleanTree(RemoveNulls=True, RemoveInvalid=True, RemoveEmpty=invert(False), Tree=dispatch_11.ListB)

# ----
# 說明:四邊形切小路分兩種規則，十字與一字，
# 接近正矩形者切十字，稍長的切一字
clean_11 = CleanTree(RemoveNulls=True, RemoveInvalid=True, RemoveEmpty=invert(False), Tree=dispatch_8.ListB)
srf_7 = Surface(dispatch_7.ListB)
rotate_6 = Rotate(Geometry=pl, Angle=expr("-x", degrees(random)), Plane=PlaneXY(0, 0, 0))  # -> Geometry, Transform
crv_20 = Curve(clean_11)
clean_12 = CleanTree(RemoveNulls=True, RemoveInvalid=True, RemoveEmpty=invert(False), Tree=srf_7)
panel_74 = Panel(clean_11)
cluster_9 = Cluster(obj=crv_20, plane=rotate_6.Geometry)  # -> brep, edge
len_9 = Length(Curve=cluster_9.edge)
item_25 = ListItem(List=len_9, Index=0, Wrap=True)  # -> Item, Item1
sort_13 = SortList(Keys=[item_25.Item, item_25.Item1])  # -> Keys, ValuesA
item_26 = ListItem(List=sort_13.Keys, Index=0, Wrap=True)  # -> Item, Item1
division_13 = Division(A=item_26.Item, B=item_26.Item1)
panel_75 = Panel(division_13)
smaller_5 = SmallerThan(FirstNumber=division_13, SecondNumber=Slider(0.5, range=0..1))  # -> SmallerThan, OrEqualTo

clean_13 = CleanTree(RemoveNulls=True, RemoveInvalid=True, RemoveEmpty=invert(False), Tree=dispatch_10.ListA)
clean_14 = CleanTree(RemoveNulls=True, RemoveInvalid=True, RemoveEmpty=invert(False), Tree=dispatch_11.ListA)

# ----
# 說明:在頂點的三角地為四邊形，須制訂條件式
# 去規劃小路，此處是先找出90度角
# 找出90度附近的邊
explode_4 = Explode(Curve=clean_9, Recursive=True)  # -> Segments, Vertices
shift_20 = ShiftList(List=explode_4.Segments, Shift=1, Wrap=True)
crv_21 = Curve(explode_4.Segments)
angle = Angle(VectorA=graft(crv_21), VectorB=graft(shift_20))  # -> Angle, Reflex
merge_10 = Merge(Data1=angle.Angle, Data2=angle.Reflex)
merge_11 = Merge(Data1=simplify(graft(crv_21)), Data2=simplify(graft(shift_20)))
sort_14 = SortList(Keys=merge_10)  # -> Keys, ValuesA
item_27 = ListItem(List=sort_14.Keys, Index=0, Wrap=True)
join_7 = JoinCurves(Curves=merge_11, Preserve=False)
deg = Degrees(Radians=item_27)
equalst = EqualityWithinTolerance(FirstNumber=deg, SecondNumber="90", Tolerance="10")  # -> Equality, Inequality
dispatch_12 = Dispatch(List=join_7, DispatchPattern=equalst.Equality)  # -> ListA, ListB
crv_22 = Curve(dispatch_12.ListA)

explode_5 = Explode(Curve=clean_13, Recursive=True)  # -> Segments, Vertices
viewer = ParamViewer(clean_13)
viewer_2 = ParamViewer(clean_9)
len_10 = Length(Curve=explode_5.Segments)
sort_15 = SortList(Keys=len_10, ValuesA=explode_5.Segments)  # -> Keys, reverse(ValuesA)
item_28 = ListItem(List=sort_15.ValuesA, Index=0, Wrap=True)  # -> Item, Item1, Item2

# ----
# 說明:取第二長邊切分第一條小路
crv_23 = Curve(item_28.Item1)
midpt_3 = CurveMiddle(Curve=crv_23)
rotate_7 = Rotate(Geometry=crv_23, Angle=degrees("90"), Plane=midpt_3)  # -> Geometry, Transform
clx = CurveLine(Curve=clean_13, Line=rotate_7.Geometry)  # -> Points, Params, Count
item_29 = ListItem(List=clx.Points, Index=0, Wrap=True)  # -> Item, Item1
ln_2 = Line(StartPoint=item_29.Item, EndPoint=item_29.Item1)

crv_24 = Curve(item_28.Item2)
midpt_4 = CurveMiddle(Curve=crv_24)

# ----
# 判斷是否適合切十字
dispatch_13 = Dispatch(List=clean_12, DispatchPattern=smaller_5.SmallerThan)  # -> ListA, ListB
dispatch_14 = Dispatch(List=cluster_9.edge, DispatchPattern=smaller_5.SmallerThan)  # -> ListA, ListB

clean_15 = CleanTree(RemoveNulls=True, RemoveInvalid=True, RemoveEmpty=invert(False), Tree=dispatch_13.ListB)
clean_16 = CleanTree(RemoveNulls=True, RemoveInvalid=True, RemoveEmpty=invert(False), Tree=dispatch_13.ListA)
clean_17 = CleanTree(RemoveNulls=True, RemoveInvalid=True, RemoveEmpty=invert(False), Tree=dispatch_14.ListA)
clean_18 = CleanTree(RemoveNulls=True, RemoveInvalid=True, RemoveEmpty=invert(False), Tree=dispatch_14.ListB)
crv_25 = Curve(clean_17)
crv_26 = Curve(clean_18)
len_11 = Length(Curve=crv_25)
explode_6 = Explode(Curve=crv_26, Recursive=True)  # -> Segments, Vertices

# ----
# 說明:取第一條小路中點連線第三長邊
midpt_5 = CurveMiddle(Curve=ln_2)
pull_2 = PullPoint(Point=midpt_5, Geometry=crv_24, ClosestOnly=True)  # -> ClosestPoint, Distance
ln_3 = Line(StartPoint=midpt_5, EndPoint=pull_2.ClosestPoint)

sort_16 = SortList(Keys=len_11, ValuesA=crv_25)  # -> Keys, ValuesA
midpt_6 = CurveMiddle(Curve=explode_6.Segments)
ext_3 = ExtendCurve(Curve=ln_2, Type=0, Start="100", End="100")
shift_21 = ShiftPaths(Data=midpt_6, Offset=-1)
item_30 = ListItem(List=reverse(sort_16.ValuesA), Index=0, Wrap=True)  # -> Item, Item1
item_31 = ListItem(List=shift_21, Index=0, Wrap=True)  # -> Item, Item1, Item2, Item3
midpt_7 = CurveMiddle(Curve=[item_30.Item, item_30.Item1])
ext_4 = ExtendCurve(Curve=ln_3, Type=0, Start="0", End="100")
offset_2 = OffsetCurve(Curve=ext_3, Distance=[neg, "6"], Plane=PlaneXY(0, 0, 0), Corners=1)
ln_4 = Line(StartPoint=item_31.Item, EndPoint=item_31.Item2)
ln_5 = Line(StartPoint=item_31.Item1, EndPoint=item_31.Item3)
pline_3 = PolyLine(Vertices=midpt_7, Closed=False)
shift_22 = ShiftPaths(Data=offset_2, Offset=-1)
ext_5 = ExtendCurve(Curve=pline_3, Type=0, Start="100", End="100")
merge_12 = Merge(Data1=ln_4, Data2=ln_5)
offset_3 = OffsetCurve(Curve=ext_4, Distance=[neg_2, "6"], Plane=PlaneXY(0, 0, 0), Corners=1)
end_2 = EndPoints(Curve=shift_22)  # -> Start, End
ext_6 = ExtendCurve(Curve=merge_12, Type=0, Start="100", End="100")  # -> graft(Curve)
shift_23 = ShiftPaths(Data=offset_3, Offset=-1)
offset_4 = OffsetCurve(Curve=ext_5, Distance=[neg_3, "6"], Plane=PlaneXY(0, 0, 0), Corners=1)
pline_4 = PolyLine(Vertices=end_2.End, Closed=False)
pline_5 = PolyLine(Vertices=end_2.Start, Closed=False)
offset_5 = OffsetCurve(Curve=ext_6, Distance=[neg_4, "6"], Plane=PlaneXY(0, 0, 0), Corners=1)
end_3 = EndPoints(Curve=shift_23)  # -> Start, End
shift_24 = ShiftPaths(Data=offset_4, Offset=-1)
shift_25 = ShiftPaths(Data=offset_5, Offset=-1)
join_8 = JoinCurves(Curves=[shift_22, pline_5, pline_4], Preserve=False)
pline_6 = PolyLine(Vertices=end_3.End, Closed=False)
pline_7 = PolyLine(Vertices=end_3.Start, Closed=False)
end_4 = EndPoints(Curve=shift_24)  # -> Start, End
end_5 = EndPoints(Curve=shift_25)  # -> Start, End
pline_8 = PolyLine(Vertices=end_4.End, Closed=False)
pline_9 = PolyLine(Vertices=end_4.Start, Closed=False)
join_9 = JoinCurves(Curves=[shift_23, pline_7, pline_6], Preserve=False)
pline_10 = PolyLine(Vertices=end_5.End, Closed=False)
pline_11 = PolyLine(Vertices=end_5.Start, Closed=False)

# ----
# 路徑
join_10 = JoinCurves(Curves=[shift_24, pline_9, pline_8], Preserve=False)  # -> simplify(Curves)

edges_2 = BrepEdges(Brep=clean_14)  # -> Naked, Interior, NonManifold

# ----
# 說明:小路合集
runion_2 = RegionUnion(Curves=[join_8, join_9])  # -> simplify(Result)

edges_3 = BrepEdges(Brep=clean_16)  # -> Naked, Interior, NonManifold
edges_4 = BrepEdges(Brep=clean_15)  # -> Naked, Interior, NonManifold
join_11 = JoinCurves(Curves=[shift_25, pline_11, pline_10], Preserve=False)
tstat_14 = TreeStatistics(Tree=join_10)  # -> Paths, Length, Count
join_12 = JoinCurves(Curves=edges_2.Naked, Preserve=False)  # -> simplify(Curves)
shift_26 = ShiftPaths(Data=simplify(join_11), Offset=-1)
join_13 = JoinCurves(Curves=edges_3.Naked, Preserve=False)  # -> simplify(Curves)
join_14 = JoinCurves(Curves=edges_4.Naked, Preserve=False)  # -> simplify(Curves)
dpath_2 = DeconstructPath(Branch=tstat_14.Paths)

# ----
# 路徑
runion_3 = RegionUnion(Curves=shift_26)

item_32 = ListItem(List=dpath_2, Index=0, Wrap=True)
item_33 = ListItem(List=join_12, Index=0, Wrap=True)  # -> Item, Item1
item_34 = ListItem(List=join_13, Index=0, Wrap=True)  # -> Item, Item1
item_35 = ListItem(List=join_14, Index=0, Wrap=True)  # -> Item, Item1
tstat_15 = TreeStatistics(Tree=crv_26)  # -> Paths, Length, Count
path_6 = ConstructPath(Indices=item_32)
rdiff_4 = RegionDifference(CurvesA=item_33.Item, CurvesB=runion_2)

# ----
# 內框
crv_27 = Curve(item_34.Item1)

# ----
# 內框
crv_28 = Curve(item_35.Item1)

dpath_3 = DeconstructPath(Branch=tstat_15.Paths)
rdiff_5 = RegionDifference(CurvesA=item_35.Item, CurvesB=runion_3)
rdiff_6 = RegionDifference(CurvesA=rdiff_4, CurvesB=item_33.Item1)
item_36 = ListItem(List=dpath_3, Index=0, Wrap=True)

# ----
# 街廓
branch_9 = TreeBranch(Tree=crv_14, Path=path_6, MaintainPaths=True)

rdiff_7 = RegionDifference(CurvesA=rdiff_5, CurvesB=item_35.Item1)
rdiff_8 = RegionDifference(CurvesA=item_34.Item, CurvesB=join_10)
boundary_4 = BoundarySurfaces(Edges=rdiff_6)
tstat_16 = TreeStatistics(Tree=boundary_4)  # -> Paths, Length, Count
path_7 = ConstructPath(Indices=item_36)
dpath_4 = DeconstructPath(Branch=tstat_16.Paths)
rdiff_9 = RegionDifference(CurvesA=rdiff_8, CurvesB=crv_27)

# ----
# 街廓
branch_10 = TreeBranch(Tree=crv_14, Path=path_7, MaintainPaths=True)

item_37 = ListItem(List=dpath_4, Index=0, Wrap=True)
path_8 = ConstructPath(Indices=item_37)
rdiff_10 = RegionDifference(CurvesA=branch_10, CurvesB=runion_3)
rdiff_11 = RegionDifference(CurvesA=branch_9, CurvesB=join_10)

# ----
# 路徑
crv_29 = Curve(simplify(runion_2))

# ----
# 街廓
branch_11 = TreeBranch(Tree=crv_15, Path=path_8, MaintainPaths=True)

# ----
# 內框
crv_30 = Curve(item_33.Item1)

# ----
# 方形切一刀
rdiff_12 = RegionDifference(CurvesA=crv_27, CurvesB=join_10)
rdiff_13 = RegionDifference(CurvesA=rdiff_11, CurvesB=crv_27)
boundary_5 = BoundarySurfaces(Edges=rdiff_9)

# ----
# 方形切十字
rdiff_14 = RegionDifference(CurvesA=crv_28, CurvesB=runion_3)
boundary_6 = BoundarySurfaces(Edges=rdiff_7)
rdiff_15 = RegionDifference(CurvesA=rdiff_10, CurvesB=crv_28)

rdiff_16 = RegionDifference(CurvesA=branch_11, CurvesB=crv_29)
crv_31 = Curve(rdiff_15)

rdiff_17 = RegionDifference(CurvesA=crv_30, CurvesB=crv_29)
rdiff_18 = RegionDifference(CurvesA=rdiff_16, CurvesB=crv_30)
brep_5 = Brep(boundary_4)

edges_5 = BrepEdges(Brep=clean_10)  # -> Naked, Interior, NonManifold
join_15 = JoinCurves(Curves=edges_5.Naked, Preserve=False)  # -> simplify(Curves)
item_38 = ListItem(List=join_15, Index=0, Wrap=True)  # -> Item, Item1

# ----
# 內框
crv_32 = Curve(item_38.Item1)

# ----
# 說明:全部可能的深度建築與建地面積相除，取
# 最接近建蔽率的建築深度
unflatten_9 = UnflattenTree(Tree=item_19, Guide=repeat_8)
end_6 = EndPoints(Curve=repeat_8)  # -> Start, End
end_7 = EndPoints(Curve=unflatten_9)  # -> Start, End
ln_6 = Line(StartPoint=end_6.Start, EndPoint=end_7.Start)  # -> simplify(Line)
ln_7 = Line(StartPoint=end_6.End, EndPoint=end_7.End)  # -> simplify(Line)
crv_33 = Curve(crv_8)
repeat_9 = RepeatData(Data=crv_33, Length=number_slider_31)  # -> simplify(graft(Data))
relay = Relay()
merge_13 = Merge(Data1=ln_6, Data2=ln_7, Data3=repeat_8, Data4=unflatten_9)
join_16 = JoinCurves(Curves=merge_13, Preserve=False)  # -> simplify(Curves)
rint = RegionIntersection(CurvesA=repeat_9, CurvesB=join_16)  # -> simplify(Result)
shift_27 = ShiftPaths(Data=rint, Offset=-1)
crv_34 = Curve(simplify(runion))
brep_6 = Brep(clean_4)
lng_15 = ListLength(List=shift_27)
group_3 = Group(Objects=crv_34)
repeat_10 = RepeatData(Data=group_3, Length=lng_15)  # -> simplify(Data)
ungroup_2 = Ungroup(Group=repeat_10)
rdiff_19 = RegionDifference(CurvesA=rint, CurvesB=ungroup_2)  # -> simplify(Result)
group_4 = Group(Objects=rdiff_19)
shift_28 = ShiftPaths(Data=group_4, Offset=-1)
flip_5 = FlipMatrix(Data=shift_28)
ungroup_3 = Ungroup(Group=flip_5)
area_21 = Area(Geometry=flatten(brep_6))  # -> Area, Centroid
shift_29 = ShiftPaths(Data=ungroup_3, Offset=-1)
area_22 = Area(Geometry=shift_29)  # -> Area, Centroid
ma_11 = MassAddition(Input=area_21.Area)  # -> Result, PartialResults
panel_76 = Panel(random_2)
ma_12 = MassAddition(Input=area_22.Area)  # -> Result, PartialResults
panel_77 = Panel(ma_11.Result)
division_14 = Division(A=ma_12.Result, B=ma_11.Result)
tstat_17 = TreeStatistics(Tree=shift_29)  # -> Paths, Length, Count
tstat_18 = TreeStatistics(Tree=group_4)  # -> Paths, Length, Count
dpath_5 = DeconstructPath(Branch=tstat_18.Paths)
item_39 = ListItem(List=dpath_5, Index=0, Wrap=True)  # -> Item, Item1

# ----
# 回補面積
panel_78 = Panel("-0.1")
subtraction_13 = Subtraction(A=division_14, B=panel_78)

subtraction_14 = Subtraction(A=subtraction_13, B=panel_76)
abs_3 = Absolute(Value=subtraction_14)  # -> flatten(Result)
sort_17 = SortList(Keys=abs_3, ValuesA=tstat_17.Paths)  # -> Keys, ValuesA
item_40 = ListItem(List=sort_17.ValuesA, Index=0, Wrap=True)
dpath_6 = DeconstructPath(Branch=item_40)
equals_10 = Equality(FirstNumber=item_39.Item1, SecondNumber=dpath_6)  # -> Equality, Inequality
dispatch_15 = Dispatch(List=graft(tstat_18.Paths), DispatchPattern=equals_10.Equality)  # -> ListA, ListB
branch_12 = TreeBranch(Tree=group_4, Path=dispatch_15.ListA, MaintainPaths=True)  # -> simplify(Branch)

ungroup_4 = Ungroup(Group=branch_12)

# ----
# 圍合式建築地
boundary_7 = BoundarySurfaces(Edges=ungroup_4)

# ----
# 草地
rdiff_20 = RegionDifference(CurvesA=rdiff_2, CurvesB=ungroup_4)  # -> simplify(Result)

# ----
# 街廓
rdiff_21 = RegionDifference(CurvesA=rdiff, CurvesB=rdiff_20)

# ----
# 說明:找出形成90度的邊，取最長的邊之中點切
# 出第一條線，但原整塊基地過於畸形的話，有機
# 會連90度角都沒有，發生這種狀況會報錯，因此
# 需寫條件式
shift_30 = ShiftPaths(Data=crv_22, Offset=-1)  # -> simplify(Data)
item_41 = ListItem(List=shift_30, Index=0, Wrap=True)
explode_7 = Explode(Curve=graft(item_41), Recursive=True)  # -> Segments, Vertices
len_12 = Length(Curve=explode_7.Segments)
sort_18 = SortList(Keys=len_12, ValuesA=explode_7.Segments)  # -> Keys, ValuesA
item_42 = ListItem(List=reverse(sort_18.ValuesA), Index=0, Wrap=True)  # -> Item, Item1
crv_35 = Curve(item_42.Item)
crv_36 = Curve(item_42.Item1)
midpt_8 = CurveMiddle(Curve=crv_35)
midpt_9 = CurveMiddle(Curve=crv_36)
rotate_8 = Rotate(Geometry=crv_35, Angle=degrees("90"), Plane=midpt_8)  # -> Geometry, Transform
clx_2 = CurveLine(Curve=clean_9, Line=simplify(rotate_8.Geometry))  # -> Points, Params, Count
cluster_10 = Cluster_2(data=clx_2.Points, data_2=clean_9)
item_43 = ListItem(List=cluster_10, Index=0, Wrap=True)  # -> Item, Item1
ln_8 = Line(StartPoint=item_43.Item, EndPoint=item_43.Item1)

# ----
# 說明:倘若沒有90度的角，會沒有切口
# ，偵測數目為0時，切一刀
lng_16 = ListLength(List=shift_30)
equals_11 = Equality(FirstNumber=lng_16, SecondNumber="0")  # -> Equality, Inequality
dispatch_16 = Dispatch(List=lng_16, DispatchPattern=equals_11.Equality)  # -> ListA, ListB
clean_19 = CleanTree(RemoveNulls=True, RemoveInvalid=True, RemoveEmpty=invert(False), Tree=dispatch_16.ListA)
crv_37 = Curve(simplify(crv_21))
tstat_19 = TreeStatistics(Tree=clean_19)  # -> Paths, Length, Count
branch_13 = TreeBranch(Tree=crv_37, Path=tstat_19.Paths, MaintainPaths=True)
len_13 = Length(Curve=branch_13)
join_17 = JoinCurves(Curves=branch_13, Preserve=False)  # -> simplify(Curves)
sort_19 = SortList(Keys=len_13, ValuesA=branch_13)  # -> Keys, ValuesA
item_44 = ListItem(List=reverse(sort_19.ValuesA), Index=0, Wrap=True)
area_23 = Area(Geometry=join_17)  # -> Area, Centroid
midpt_10 = CurveMiddle(Curve=item_44)
rotate_9 = Rotate(Geometry=item_44, Angle=degrees("90"), Plane=midpt_10)  # -> Geometry, Transform
clx_3 = CurveLine(Curve=join_17, Line=rotate_9.Geometry)  # -> Points, Params, Count
pline_12 = PolyLine(Vertices=clx_3.Points, Closed=False)

# ----
# 讓weave的1不會因為
# empty而發黃
null_2 = NullItem(Item=flatten(pline_12))  # -> NullFlags, InvalidFlags, Description
item_45 = ListItem(List=null_2.NullFlags, Index=0, Wrap=True)
filter_2 = StreamFilter(Gate=null_2.NullFlags, Stream0=pline_12, Stream1=item_45)

panel_79 = Panel(equals_11.Equality)
weave_5 = Weave(Pattern=equals_11.Equality, Stream0=ln_8, Stream1=filter_2, NullGaps=False)
panel_80 = Panel(weave_5)

midpt_11 = CurveMiddle(Curve=weave_5)
ext_7 = ExtendCurve(Curve=weave_5, Type=0, Start="100", End="100")
pull_3 = PullPoint(Point=midpt_11, Geometry=crv_36, ClosestOnly=True)  # -> ClosestPoint, Distance
cluster_11 = Cluster_2(data=pull_3.ClosestPoint, data_2=clean_9)
ln_9 = Line(StartPoint=midpt_11, EndPoint=cluster_11)
ext_8 = ExtendCurve(Curve=ln_9, Type=0, Start="0", End="100")
offset_6 = OffsetCurve(Curve=ext_7, Distance=[neg_5, "6"], Plane=PlaneXY(0, 0, 0), Corners=1)
shift_31 = ShiftPaths(Data=offset_6, Offset=-1)
offset_7 = OffsetCurve(Curve=ext_8, Distance=[neg_6, "6"], Plane=PlaneXY(0, 0, 0), Corners=1)
end_8 = EndPoints(Curve=shift_31)  # -> Start, End
shift_32 = ShiftPaths(Data=offset_7, Offset=-1)
pline_13 = PolyLine(Vertices=end_8.End, Closed=False)
pline_14 = PolyLine(Vertices=end_8.Start, Closed=False)
end_9 = EndPoints(Curve=shift_32)  # -> Start, End
join_18 = JoinCurves(Curves=[shift_31, pline_14, pline_13], Preserve=False)
pline_15 = PolyLine(Vertices=end_9.End, Closed=False)
pline_16 = PolyLine(Vertices=end_9.Start, Closed=False)
join_19 = JoinCurves(Curves=[shift_32, pline_16, pline_15], Preserve=False)

# ----
# 路徑
runion_4 = RegionUnion(Curves=[join_18, join_19])  # -> simplify(Result)

tstat_20 = TreeStatistics(Tree=runion_4)  # -> Paths, Length, Count
dpath_7 = DeconstructPath(Branch=tstat_20.Paths)
item_46 = ListItem(List=dpath_7, Index=0, Wrap=True)
rdiff_22 = RegionDifference(CurvesA=item_38.Item, CurvesB=runion_4)
path_9 = ConstructPath(Indices=item_46)
rdiff_23 = RegionDifference(CurvesA=rdiff_22, CurvesB=item_38.Item1)

# ----
# 街廓
branch_14 = TreeBranch(Tree=crv_16, Path=path_9, MaintainPaths=True)

rdiff_24 = RegionDifference(CurvesA=branch_14, CurvesB=runion_4)

boundary_8 = BoundarySurfaces(Edges=rdiff_23)
rdiff_25 = RegionDifference(CurvesA=rdiff_24, CurvesB=crv_32)
rdiff_26 = RegionDifference(CurvesA=crv_32, CurvesB=runion_4)

# ---- group: 混和式大樓group
# 外框
# 建築
# 可建範圍
# 外框
# 建築
# 可建範圍
# 外框
# 建築
# 可建範圍
# 外框
# 建築
# 可建範圍
crv_38 = Curve(boundary_7)
brep_7 = Brep(brep_5)
crv_39 = Curve(item_34.Item)
crv_40 = Curve(boundary_5)
crv_41 = Curve(boundary_6)
brep_8 = Brep(crv_41)
# 取出最長邊以及對邊
# 目標面積根據建地最短邊去變形為適合的矩形
# 根據建蔽率決定每塊建築面積，此處條件式是根
# 據建地矩形的最短邊是否超過所需面積的邊長，
# 所需面積的邊長大於最短邊則分至A，小於則是
# 分至B
# 維持正方形
brep_9 = Brep(rdiff_3)
crv_42 = Curve(item_33.Item)
crv_43 = Curve(item_38.Item)
brep_10 = Brep(boundary_8)
brep_11 = Brep(rdiff_22)
brep_12 = Brep(rdiff_8)
crv_44 = Curve(item_35.Item)
brep_13 = Brep(rdiff_5)
crv_45 = Curve(crv_8)
brep_14 = Brep(rdiff_4)

# ----
area_24 = Area(Geometry=brep_8)  # -> Area, Centroid
brep_15 = Brep(brep_10)
brep_16 = Brep(crv_40)
area_25 = Area(Geometry=brep_15)  # -> Area, Centroid
smaller_6 = SmallerThan(FirstNumber=area_24.Area, SecondNumber="500")  # -> SmallerThan, OrEqualTo
area_26 = Area(Geometry=brep_16)  # -> Area, Centroid
smaller_7 = SmallerThan(FirstNumber=area_25.Area, SecondNumber="500")  # -> SmallerThan, OrEqualTo
dispatch_17 = Dispatch(List=brep_8, DispatchPattern=smaller_6.SmallerThan)  # -> ListA, ListB
smaller_8 = SmallerThan(FirstNumber=area_26.Area, SecondNumber="500")  # -> SmallerThan, OrEqualTo
area_27 = Area(Geometry=brep_13)  # -> Area, Centroid
area_28 = Area(Geometry=brep_7)  # -> Area, Centroid
dispatch_18 = Dispatch(List=brep_15, DispatchPattern=smaller_7.SmallerThan)  # -> ListA, ListB
brep_17 = Brep(dispatch_17.ListB)
area_29 = Area(Geometry=brep_11)  # -> Area, Centroid
panel_81 = Panel(area_27.Area)
dispatch_19 = Dispatch(List=brep_16, DispatchPattern=smaller_8.SmallerThan)  # -> ListA, ListB
smaller_9 = SmallerThan(FirstNumber=area_27.Area, SecondNumber=Slider(1800, range=0..10000))  # -> SmallerThan, OrEqualTo
smaller_10 = SmallerThan(FirstNumber=area_28.Area, SecondNumber="500")  # -> SmallerThan, OrEqualTo
crv_46 = Curve(brep_13)
area_30 = Area(Geometry=brep_12)  # -> Area, Centroid
brep_18 = Brep(dispatch_18.ListB)
panel_82 = Panel(area_29.Area)
smaller_11 = SmallerThan(FirstNumber=area_29.Area, SecondNumber=Slider(1849, range=0..10000))  # -> SmallerThan, OrEqualTo
dispatch_20 = Dispatch(List=crv_46, DispatchPattern=smaller_9.SmallerThan)  # -> ListA, ListB
crv_47 = Curve(brep_11)
dispatch_21 = Dispatch(List=brep_17, DispatchPattern=smaller_9.SmallerThan)  # -> ListA, ListB
dispatch_22 = Dispatch(List=brep_7, DispatchPattern=smaller_10.SmallerThan)  # -> ListA, ListB
brep_19 = Brep(dispatch_19.ListB)
panel_83 = Panel(area_30.Area)
smaller_12 = SmallerThan(FirstNumber=area_30.Area, SecondNumber=Slider(1849, range=0..10000))  # -> SmallerThan, OrEqualTo
area_31 = Area(Geometry=brep_14)  # -> Area, Centroid
crv_48 = Curve(brep_12)
dispatch_23 = Dispatch(List=crv_47, DispatchPattern=smaller_11.SmallerThan)  # -> ListA, ListB
dispatch_24 = Dispatch(List=brep_18, DispatchPattern=smaller_11.SmallerThan)  # -> ListA, ListB
brep_20 = Brep(dispatch_21.ListB)
dispatch_25 = Dispatch(List=crv_48, DispatchPattern=smaller_12.SmallerThan)  # -> ListA, ListB
brep_21 = Brep(dispatch_22.ListB)
dispatch_26 = Dispatch(List=brep_19, DispatchPattern=smaller_12.SmallerThan)  # -> ListA, ListB
smaller_13 = SmallerThan(FirstNumber=area_31.Area, SecondNumber=Slider(1849, range=0..10000))  # -> SmallerThan, OrEqualTo
crv_49 = Curve(brep_14)
area_32 = Area(Geometry=brep_20)  # -> Area, Centroid
brep_22 = Brep(dispatch_24.ListB)
brep_23 = Brep(dispatch_26.ListB)
dispatch_27 = Dispatch(List=crv_49, DispatchPattern=smaller_13.SmallerThan)  # -> ListA, ListB
dispatch_28 = Dispatch(List=brep_21, DispatchPattern=smaller_13.SmallerThan)  # -> ListA, ListB
area_33 = Area(Geometry=brep_22)  # -> Area, Centroid
area_34 = Area(Geometry=brep_23)  # -> Area, Centroid
crv_50 = Curve(brep_20)
brep_24 = Brep(dispatch_28.ListB)
crv_cp_2 = CurveClosestPoint(Point=area_32.Centroid, Curve=reparameterize(crv_44))  # -> Point, Parameter, Distance
brep_25 = Brep(crv_38)

# ----
# 先取最近點，然後隨機偏移
crv_51 = Curve(brep_22)
crv_cp_3 = CurveClosestPoint(Point=area_33.Centroid, Curve=reparameterize(crv_43))  # -> Point, Parameter, Distance
lng_17 = ListLength(List=flatten(crv_cp_3.Point))
dom_5 = ConstructDomain(DomainStart="-0.05", DomainEnd="0.05")
random_8 = Random(Range=dom_5, Number=lng_17, Seed=2)
unflatten_10 = UnflattenTree(Tree=random_8, Guide=crv_cp_3.Point)
addition_5 = Addition(A=unflatten_10, B=crv_cp_3.Parameter)
mod = Modulus(A=addition_5, B="1")
abs_4 = Absolute(Value=mod)
eval = EvaluateCurve(Curve=reparameterize(crv_43), Parameter=abs_4)  # -> Point, Tangent, Angle

area_35 = Area(Geometry=brep_24)  # -> Area, Centroid
area_36 = Area(Geometry=brep_25)  # -> Area, Centroid
crv_52 = Curve(brep_23)
crv_cp_4 = CurveClosestPoint(Point=area_34.Centroid, Curve=reparameterize(crv_39))  # -> Point, Parameter, Distance
lng_18 = ListLength(List=flatten(crv_cp_2.Point))
smaller_14 = SmallerThan(FirstNumber=area_36.Area, SecondNumber="500")  # -> SmallerThan, OrEqualTo
random_9 = Random(Range=dom, Number=lng_18, Seed=2)
lng_19 = ListLength(List=flatten(crv_cp_4.Point))
dispatch_29 = Dispatch(List=brep_25, DispatchPattern=smaller_14.SmallerThan)  # -> ListA, ListB
area_37 = Area(Geometry=brep_9)  # -> Area, Centroid
unflatten_11 = UnflattenTree(Tree=random_9, Guide=crv_cp_2.Point)
random_10 = Random(Range=dom_2, Number=lng_19, Seed=2)
addition_6 = Addition(A=unflatten_11, B=crv_cp_2.Parameter)
brep_26 = Brep(dispatch_29.ListB)
crv_53 = Curve(brep_9)
panel_84 = Panel(area_37.Area)
smaller_15 = SmallerThan(FirstNumber=area_37.Area, SecondNumber=number_slider_16)  # -> SmallerThan, OrEqualTo
unflatten_12 = UnflattenTree(Tree=random_10, Guide=crv_cp_4.Point)
mod_2 = Modulus(A=addition_6, B="1")
abs_5 = Absolute(Value=mod_2)
dispatch_30 = Dispatch(List=crv_53, DispatchPattern=smaller_15.SmallerThan)  # -> ListA, ListB
dispatch_31 = Dispatch(List=brep_26, DispatchPattern=smaller_15.SmallerThan)  # -> ListA, ListB
addition_7 = Addition(A=unflatten_12, B=crv_cp_4.Parameter)
eval_2 = EvaluateCurve(Curve=reparameterize(crv_44), Parameter=abs_5)  # -> Point, Tangent, Angle
mod_3 = Modulus(A=addition_7, B="1")
abs_6 = Absolute(Value=mod_3)
brep_27 = Brep(dispatch_31.ListA)
brep_28 = Brep(dispatch_31.ListB)
item_47 = ListItem(List=brep_28, Index=0, Wrap=True)
eval_3 = EvaluateCurve(Curve=reparameterize(crv_39), Parameter=abs_6)  # -> Point, Tangent, Angle
panel_85 = Panel(brep_28)
area_38 = Area(Geometry=brep_28)  # -> Area, Centroid
cluster_12 = Cluster_3(A=num_2, B=num, data=area_32.Centroid)  # -> I_2, I
cluster_13 = Cluster_3(A=num_2, B=num, data=area_38.Centroid)  # -> I_2, I
cluster_14 = Cluster_3(A=num_2, B=num, data=area_33.Centroid)  # -> I_2, I
rectangle_2 = Rectangle(Plane=area_32.Centroid, XSize=cluster_12.I_2, YSize=cluster_12.I, Radius=0)  # -> Rectangle, Length
cluster_15 = Cluster_3(A=num_2, B=num, data=area_34.Centroid)  # -> I_2, I
rectangle_3 = Rectangle(Plane=area_38.Centroid, XSize=cluster_13.I_2, YSize=cluster_13.I, Radius=0)  # -> Rectangle, Length
crv_cp_5 = CurveClosestPoint(Point=area_38.Centroid, Curve=crv_45)  # -> Point, Parameter, Distance
pl_2 = PlaneNormal(Origin=area_32.Centroid, ZAxis=Vector(0, 0, 1))
rectangle_4 = Rectangle(Plane=area_33.Centroid, XSize=cluster_14.I_2, YSize=cluster_14.I, Radius=0)  # -> Rectangle, Length
ln_10 = Line(StartPoint=eval_2.Point, EndPoint=area_32.Centroid)
cluster_16 = Cluster_3(A=num_2, B=num, data=area_35.Centroid)  # -> I_2, I
rectangle_5 = Rectangle(Plane=area_34.Centroid, XSize=cluster_15.I_2, YSize=cluster_15.I, Radius=0)  # -> Rectangle, Length
pl_3 = PlaneNormal(Origin=area_38.Centroid, ZAxis=Vector(0, 0, 1))
pl_4 = PlaneNormal(Origin=area_33.Centroid, ZAxis=Vector(0, 0, 1))
ln_11 = Line(StartPoint=eval.Point, EndPoint=area_33.Centroid)
ln_12 = Line(StartPoint=crv_cp_5.Point, EndPoint=area_38.Centroid)
crv_cp_6 = CurveClosestPoint(Point=area_35.Centroid, Curve=crv_42)  # -> Point, Parameter, Distance
pl_5 = PlaneNormal(Origin=area_34.Centroid, ZAxis=Vector(0, 0, 1))
align = AlignPlane(Plane=pl_2, Direction=eval_2.Tangent)  # -> Plane, Angle
ln_13 = Line(StartPoint=eval_3.Point, EndPoint=area_34.Centroid)
rectangle_6 = Rectangle(Plane=area_35.Centroid, XSize=cluster_16.I_2, YSize=cluster_16.I, Radius=0)  # -> Rectangle, Length
align_2 = AlignPlane(Plane=pl_3, Direction=ln_12)  # -> Plane, Angle
align_3 = AlignPlane(Plane=pl_4, Direction=eval.Tangent)  # -> Plane, Angle
orient_2 = Orient(Geometry=rectangle_2.Rectangle, Source=area_32.Centroid, Target=align.Plane)  # -> Geometry, Transform
ext_9 = ExtendCurve(Curve=ln_10, Type=0, Start="50", End="0")
pl_6 = PlaneNormal(Origin=area_35.Centroid, ZAxis=Vector(0, 0, 1))
ln_14 = Line(StartPoint=crv_cp_6.Point, EndPoint=area_35.Centroid)
align_4 = AlignPlane(Plane=pl_5, Direction=eval_3.Tangent)  # -> Plane, Angle
orient_3 = Orient(Geometry=rectangle_3.Rectangle, Source=area_38.Centroid, Target=align_2.Plane)  # -> Geometry, Transform
orient_4 = Orient(Geometry=rectangle_4.Rectangle, Source=area_33.Centroid, Target=align_3.Plane)  # -> Geometry, Transform
ext_10 = ExtendCurve(Curve=ln_12, Type=0, Start="50", End="0")
ext_11 = ExtendCurve(Curve=ln_11, Type=0, Start="50", End="0")
ccx = CurveCurve(CurveA=ext_9, CurveB=orient_2.Geometry)  # -> Points, ParamsA, ParamsB
orient_5 = Orient(Geometry=rectangle_5.Rectangle, Source=area_34.Centroid, Target=align_4.Plane)  # -> Geometry, Transform
ext_12 = ExtendCurve(Curve=ln_13, Type=0, Start="50", End="0")
align_5 = AlignPlane(Plane=pl_6, Direction=ln_14)  # -> Plane, Angle
ccx_2 = CurveCurve(CurveA=ext_10, CurveB=orient_3.Geometry)  # -> Points, ParamsA, ParamsB
ccx_3 = CurveCurve(CurveA=ext_11, CurveB=orient_4.Geometry)  # -> Points, ParamsA, ParamsB
shift_33 = ShiftPaths(Data=ccx.Points, Offset=-1)
ccx_4 = CurveCurve(CurveA=ext_12, CurveB=orient_5.Geometry)  # -> Points, ParamsA, ParamsB
orient_6 = Orient(Geometry=rectangle_6.Rectangle, Source=area_35.Centroid, Target=align_5.Plane)  # -> Geometry, Transform
ext_13 = ExtendCurve(Curve=ln_14, Type=0, Start="50", End="0")
shift_34 = ShiftPaths(Data=ccx_2.Points, Offset=-1)
shift_35 = ShiftPaths(Data=ccx_3.Points, Offset=-1)
orient_7 = Orient(Geometry=orient_2.Geometry, Source=shift_33, Target=eval_2.Point)  # -> Geometry, Transform
ccx_5 = CurveCurve(CurveA=ext_13, CurveB=orient_6.Geometry)  # -> Points, ParamsA, ParamsB
crv_54 = Curve(dispatch_30.ListB)
shift_36 = ShiftPaths(Data=ccx_4.Points, Offset=-1)
orient_8 = Orient(Geometry=orient_3.Geometry, Source=shift_34, Target=crv_cp_5.Point)  # -> Geometry, Transform
brep_29 = Brep(dispatch_21.ListA)
orient_9 = Orient(Geometry=orient_4.Geometry, Source=shift_35, Target=eval.Point)  # -> Geometry, Transform
boundary_9 = BoundarySurfaces(Edges=crv_54)  # -> flatten(Surfaces)
boundary_10 = BoundarySurfaces(Edges=orient_8.Geometry)
shift_37 = ShiftPaths(Data=ccx_5.Points, Offset=-1)
orient_10 = Orient(Geometry=orient_5.Geometry, Source=shift_36, Target=eval_3.Point)  # -> Geometry, Transform
brep_30 = Brep(simplify(graft([dispatch_21.ListB, brep_29])))
brep_31 = Brep(dispatch_24.ListA)
rint_2 = RegionIntersection(CurvesA=graft(orient_7.Geometry), CurvesB=graft(dispatch_20.ListB))  # -> simplify(Result)
brep_32 = Brep(dispatch_26.ListA)
brep_33 = Brep(simplify(graft([dispatch_24.ListB, brep_31])))
colom = CollisionOneMany(Collider=boundary_9, Obstacles=graft(boundary_10))  # -> Collision, Index
edges_6 = BrepEdges(Brep=brep_30)  # -> Naked, Interior, NonManifold
rint_3 = RegionIntersection(CurvesA=graft(orient_9.Geometry), CurvesB=graft(dispatch_23.ListB))  # -> simplify(Result)
brep_34 = Brep(simplify(graft(dispatch_31.ListB)))
orient_11 = Orient(Geometry=orient_6.Geometry, Source=shift_37, Target=crv_cp_6.Point)  # -> Geometry, Transform
brep_35 = Brep(simplify(graft([dispatch_26.ListB, brep_32])))
rint_4 = RegionIntersection(CurvesA=graft(orient_10.Geometry), CurvesB=graft(dispatch_25.ListB))  # -> simplify(Result)
brep_36 = Brep(dispatch_28.ListA)
edges_7 = BrepEdges(Brep=brep_33)  # -> Naked, Interior, NonManifold
join_20 = JoinCurves(Curves=edges_6.Naked, Preserve=False)  # -> simplify(Curves)
dispatch_32 = Dispatch(List=boundary_9, DispatchPattern=colom.Collision)  # -> ListA, ListB
edges_8 = BrepEdges(Brep=brep_35)  # -> Naked, Interior, NonManifold
edges_9 = BrepEdges(Brep=brep_34)  # -> Naked, Interior, NonManifold
rint_5 = RegionIntersection(CurvesA=graft(orient_11.Geometry), CurvesB=graft(dispatch_27.ListB))  # -> simplify(Result)
brep_37 = Brep(simplify(graft([dispatch_28.ListB, brep_36])))
join_21 = JoinCurves(Curves=edges_7.Naked, Preserve=False)  # -> simplify(Curves)
shift_38 = ShiftPaths(Data=rint_2, Offset=-1)
runion_5 = RegionUnion(Curves=[join_20, rint_2])  # -> simplify(Result)
rint_6 = RegionIntersection(CurvesA=graft(orient_8.Geometry), CurvesB=graft(dispatch_32.ListA))  # -> simplify(Result)
join_22 = JoinCurves(Curves=edges_8.Naked, Preserve=False)  # -> simplify(Curves)
shift_39 = ShiftPaths(Data=rint_3, Offset=-1)
runion_6 = RegionUnion(Curves=[join_21, rint_3])  # -> simplify(Result)
shift_40 = ShiftPaths(Data=runion_5, Offset=-1)
join_23 = JoinCurves(Curves=edges_9.Naked, Preserve=False)  # -> simplify(Curves)
runion_7 = RegionUnion(Curves=[rint_5, brep_37])  # -> simplify(Result)
shift_41 = ShiftPaths(Data=rint_4, Offset=-1)
runion_8 = RegionUnion(Curves=[join_22, rint_4])  # -> simplify(Result)
shift_42 = ShiftPaths(Data=rint_5, Offset=-1)
shift_43 = ShiftPaths(Data=rint_6, Offset=-1)
shift_44 = ShiftPaths(Data=runion_6, Offset=-1)
# 大樓
boundary_11 = BoundarySurfaces(Edges=shift_38)
runion_9 = RegionUnion(Curves=[rint_6, join_23])  # -> simplify(Result)
shift_45 = ShiftPaths(Data=runion_7, Offset=-1)
boundary_12 = BoundarySurfaces(Edges=shift_40)
shift_46 = ShiftPaths(Data=runion_8, Offset=-1)
# 底層
boundary_13 = BoundarySurfaces(Edges=shift_44)
# 大樓
brep_38 = Brep(shift_39)
shift_47 = ShiftPaths(Data=runion_9, Offset=-1)
# 大樓
boundary_14 = BoundarySurfaces(Edges=shift_41)
# 底層
boundary_15 = BoundarySurfaces(Edges=shift_46)
# 底層
boundary_16 = BoundarySurfaces(Edges=shift_45)
# 大樓
brep_39 = Brep(shift_42)
boundary_17 = BoundarySurfaces(Edges=shift_43)
boundary_18 = BoundarySurfaces(Edges=shift_47)

# ----
# 混和式建築大樓區域
merge_14 = Merge(
    Data1=simplify(brep_39),
    Data2=simplify(brep_38),
    Data3=simplify(boundary_14),
    Data4=simplify(boundary_11),
    Data5=simplify(boundary_17))

# ----
# 混和式建築底層區域
merge_15 = Merge(Data1=boundary_16, Data2=boundary_13, Data3=boundary_15, Data4=boundary_12, Data5=boundary_18)

edges_10 = BrepEdges(Brep=[merge_14, merge_15])  # -> Naked, Interior, NonManifold
join_24 = JoinCurves(Curves=edges_10.Naked, Preserve=False)  # -> simplify(Curves)
shift_48 = ShiftPaths(Data=join_24, Offset=-1)
tstat_21 = TreeStatistics(Tree=shift_48)  # -> Paths, Length, Count
item_48 = ListItem(List=tstat_21.Paths, Index=Slider(5, range=0..12), Wrap=True)
branch_15 = TreeBranch(Tree=shift_48, Path=item_48, MaintainPaths=True)
runion_10 = RegionUnion(Curves=shift_48)
area_39 = Area(Geometry=flatten(merge_15))  # -> Area, Centroid
panel_86 = Panel(runion_10)
ma_13 = MassAddition(Input=area_39.Area)  # -> Result, PartialResults
division_15 = Division(A=ma_13.Result, B=area_3.Area)

# ----
# 混和式建築建蔽率
panel_87 = Panel(division_15)

area_40 = Area(Geometry=merge_14)  # -> flatten(Area), Centroid
ma_14 = MassAddition(Input=area_40.Area)  # -> Result, PartialResults

# ----
# 底層平均層數
division_16 = Division(A=panel_10, B=ma_13.Result)

round = Round(Number=division_16)  # -> Nearest, Floor, Ceiling
int_5 = Integer(expr("x-5", round.Floor))
int_6 = Integer(expr("x+5", round.Floor))

# ----
# 設定底層樓層數範圍
panel_88 = Panel("5")
subtraction_15 = Subtraction(A=round.Floor, B=panel_88)
addition_8 = Addition(A=round.Floor, B=panel_88)
max = Maximum(A=int_5, B="3")
lng_20 = ListLength(List=flatten(merge_15))
dom_6 = ConstructDomain(DomainStart=max, DomainEnd=int_6)
random_11 = Random(Range=dom_6, Number=lng_20, Seed=addition, Integers=True)

brep_40 = Brep(merge_15)
brep_41 = Brep(merge_14)
area_41 = Area(Geometry=brep_40)  # -> Area, Centroid
unflatten_13 = UnflattenTree(Tree=random_11, Guide=brep_40)
area_42 = Area(Geometry=brep_41)  # -> Area, Centroid
multiplication_7 = Multiplication(A=flatten(area_41.Area), B=flatten(unflatten_13))
buffer = TimeBuffer(Data=multiplication_7, Ms="30000", UseThread=True)
lng_21 = ListLength(List=flatten(buffer))
panel_89 = Panel(unflatten_13)
python = GhPythonScript(a=flatten(area_41.Area), b=flatten(unflatten_13))  # -> out, output; inputs a: list of Int32, b: list of Int32
# ---------- python: Python ----------
import rhinoscriptsyntax as rs

def x():
    g = []
    for i in range(len(a)):
        c = a[i]*b[i]
        g.append(c)
    return(g)

output = x()
# ---------- end python ----------
ma_15 = MassAddition(Input=flatten(multiplication_7))  # -> Result, PartialResults
ma_16 = MassAddition(Input=flatten(python.output))  # -> Result, PartialResults
ma_17 = MassAddition(Input=flatten(area_41.Area))  # -> Result, PartialResults

# ----
# 多出面積
subtraction_16 = Subtraction(A=ma_15.Result, B=panel_10)

ma_18 = MassAddition(Input=flatten(area_42.Area))  # -> Result, PartialResults
smaller_16 = SmallerThan(FirstNumber=subtraction_16, SecondNumber="0")  # -> SmallerThan, OrEqualTo
lng_22 = ListLength(List=flatten(brep_40))
lng_23 = ListLength(List=flatten(brep_41))

# ----
# 多出面積/底層面積
division_17 = Division(A=subtraction_16, B=ma_17.Result)

filter_3 = StreamFilter(Gate=smaller_16.SmallerThan, Stream0="-1", Stream1="1")
tstat_22 = TreeStatistics(Tree=simplify(graft(random_11)))  # -> Paths, Length, Count
multiplication_8 = Multiplication(A=division_17, B=lng_22)
int_7 = Integer(multiplication_8)
abs_7 = Absolute(Value=int_7)
repeat_11 = RepeatData(Data=filter_3, Length=abs_7)  # -> graft(Data)
repeat_12 = RepeatData(Data=tstat_22.Paths, Length=abs_7)
tstat_23 = TreeStatistics(Tree=repeat_11)  # -> Paths, Length, Count
replace_5 = ReplacePaths(Data=repeat_11, Search=tstat_23.Paths, Replace=repeat_12)
ma_19 = MassAddition(Input=replace_5)  # -> flatten(Result), PartialResults
lng_24 = ListLength(List=random_11)
lng_25 = ListLength(List=ma_19.Result)
subtraction_17 = Subtraction(A=lng_24, B=lng_25)
repeat_13 = RepeatData(Data="0", Length=subtraction_17)
entwine_4 = Entwine(Branch00=ma_19.Result, Branch01=repeat_13, FlattenInputs=True)  # -> flatten(Result)
addition_9 = Addition(A=random_11, B=entwine_4)
max_2 = Maximum(A=addition_9, B="3")

# ----
# 再檢驗一次
brep_42 = Brep(merge_15)
unflatten_14 = UnflattenTree(Tree=max_2, Guide=brep_42)
area_43 = Area(Geometry=brep_42)  # -> Area, Centroid
multiplication_9 = Multiplication(A=area_43.Area, B=unflatten_14)
ma_20 = MassAddition(Input=flatten(multiplication_9))  # -> Result, PartialResults
ma_21 = MassAddition(Input=flatten(area_43.Area))  # -> Result, PartialResults

# ----
# 算完底層，再算大樓
panel_90 = Panel(ma_20.Result)
subtraction_18 = Subtraction(A=panel_9, B=panel_90)

# ----
# 大樓平均層數
division_18 = Division(A=subtraction_18, B=ma_14.Result)

round_2 = Round(Number=division_18)  # -> Nearest, Floor, Ceiling

# ----
# 設定底層樓層數範圍
panel_91 = Panel("5")
subtraction_19 = Subtraction(A=round_2.Floor, B=panel_91)
addition_10 = Addition(A=round_2.Floor, B=panel_91)
max_3 = Maximum(A=subtraction_19, B="3")
lng_26 = ListLength(List=flatten(merge_14))
dom_7 = ConstructDomain(DomainStart=max_3, DomainEnd=addition_10)
random_12 = Random(Range=dom_7, Number=lng_26, Seed=addition, Integers=True)

unflatten_15 = UnflattenTree(Tree=random_12, Guide=brep_41)
panel_92 = Panel(unflatten_15)
multiplication_10 = Multiplication(A=area_42.Area, B=unflatten_15)
ma_22 = MassAddition(Input=flatten(multiplication_10))  # -> Result, PartialResults

# ----
# 多出面積
subtraction_20 = Subtraction(A=ma_22.Result, B=subtraction_18)

smaller_17 = SmallerThan(FirstNumber=subtraction_20, SecondNumber="0")  # -> SmallerThan, OrEqualTo

# ----
# 多出面積/大樓面積
division_19 = Division(A=subtraction_20, B=ma_18.Result)

filter_4 = StreamFilter(Gate=smaller_17.SmallerThan, Stream0="-1", Stream1="1")
tstat_24 = TreeStatistics(Tree=simplify(graft(random_12)))  # -> Paths, Length, Count
multiplication_11 = Multiplication(A=division_19, B=lng_23)
int_8 = Integer(multiplication_11)
abs_8 = Absolute(Value=int_8)
repeat_14 = RepeatData(Data=filter_4, Length=abs_8)  # -> graft(Data)
repeat_15 = RepeatData(Data=tstat_24.Paths, Length=abs_8)
tstat_25 = TreeStatistics(Tree=repeat_14)  # -> Paths, Length, Count
replace_6 = ReplacePaths(Data=repeat_14, Search=tstat_25.Paths, Replace=repeat_15)
ma_23 = MassAddition(Input=replace_6)  # -> flatten(Result), PartialResults
lng_27 = ListLength(List=random_12)
lng_28 = ListLength(List=ma_23.Result)
subtraction_21 = Subtraction(A=lng_27, B=lng_28)
repeat_16 = RepeatData(Data="0", Length=subtraction_21)
entwine_5 = Entwine(Branch00=ma_23.Result, Branch01=repeat_16, FlattenInputs=True)  # -> flatten(Result)
addition_11 = Addition(A=random_12, B=entwine_5)
python_2 = GhPythonScript(a=random_12, b=entwine_5)  # -> out, output; inputs a: list of Int32, b: list of Int32
# ---------- python_2: Python ----------
import rhinoscriptsyntax as rs

output = []
for i in range(len(a)):
    c = a[i]+b[i]
    output.append(c)
# ---------- end python_2 ----------

# ----
# 再檢驗一次
brep_43 = Brep(merge_14)
area_44 = Area(Geometry=brep_43)  # -> Area, Centroid
unflatten_16 = UnflattenTree(Tree=addition_11, Guide=brep_43)
multiplication_12 = Multiplication(A=area_44.Area, B=unflatten_16)
ma_24 = MassAddition(Input=flatten(multiplication_12))  # -> Result, PartialResults
ma_25 = MassAddition(Input=flatten(area_44.Area))  # -> Result, PartialResults

# ----
# 混和式建築街廓/綠植區域
merge_16 = Merge(Data1=rdiff_18, Data2=rdiff_25, Data3=rdiff_13, Data4=rdiff_15, Data5=rdiff_21)  # -> flatten(Result)
merge_17 = Merge(Data1=rdiff_17, Data2=rdiff_26, Data3=rdiff_12, Data4=rdiff_14, Data5=rdiff_20)  # -> flatten(Result)
boundary_19 = BoundarySurfaces(Edges=merge_16)
boundary_20 = BoundarySurfaces(Edges=merge_17)

panel_93 = Panel(unflatten_14)
multiplication_13 = Multiplication(A="4", B=unflatten_14)
multiplication_14 = Multiplication(A="4", B=unflatten_16)
Z_5 = UnitZ(Factor=multiplication_13)
short = ShortestList(ListA=merge_14, ListB=Z_5, TrimMode=2)  # -> ListA, ListB
Z_6 = UnitZ(Factor=multiplication_14)
move_4 = Move(Geometry=short.ListA, Motion=short.ListB)  # -> Geometry, Transform
series_7 = Series(Start=0, Step=1, Count=unflatten_14)
series_8 = Series(Start=0, Step=1, Count=addition_11)

# ----
# 底層
extr_2 = Extrude(Base=brep_42, Direction=Z_5)

multiplication_15 = Multiplication(A=series_7, B="4")
multiplication_16 = Multiplication(A=series_8, B="4")

# ----
# 多出面積
subtraction_22 = Subtraction(A=ma_20.Result, B=panel_10)

# ----
# 多出面積
subtraction_23 = Subtraction(A=ma_24.Result, B=subtraction_18)

crv_55 = Curve(graft(brep_42))
crv_56 = Curve(graft(move_4.Geometry))
Z_7 = UnitZ(Factor=multiplication_15)
addition_12 = Addition(A=ma_24.Result, B=ma_20.Result)
Z_8 = UnitZ(Factor=multiplication_16)

area_45 = Area(Geometry=flatten(brep_42))  # -> Area, Centroid
# 屋顶面积
mass_addition = MassAddition(Input=area_45.Area)  # -> Result, PartialResults

# ----
# 大樓樓層數
area_46 = Area(Geometry=move_4.Geometry)  # -> Area, Centroid
short_2 = ShortestList(ListA=unflatten_16, ListB=unflatten_14, TrimMode=2)  # -> ListA, ListB
addition_13 = Addition(A=short_2.ListA, B=short_2.ListB)
move_5 = Move(Geometry=area_46.Centroid, Motion=Z_6)  # -> Geometry, Transform

# ----
# 多出面積/底層面積
division_20 = Division(A=subtraction_22, B=ma_21.Result)

# ----
# 多出面積/大樓面積
division_21 = Division(A=subtraction_23, B=ma_25.Result)

# ----
# 底層樓層
move_6 = Move(Geometry=crv_55, Motion=Z_7)  # -> Geometry, Transform
crv_57 = Curve(move_6.Geometry)

# ----
# 大樓
extr_3 = Extrude(Base=move_4.Geometry, Direction=Z_6)

# ----
# 大樓樓層
move_7 = Move(Geometry=crv_56, Motion=Z_8)  # -> Geometry, Transform
crv_58 = Curve(move_7.Geometry)

division_22 = Division(A=addition_12, B=area_3.Area)

# ----
# 混和式容積率
panel_94 = Panel(division_22)

merge_18 = Merge(Data1=crv_58, Data2=crv_57)

merge_19 = Merge(Data1=extr_3, Data2=extr_2)
solid_union = SolidUnion(Breps=merge_19)  # -> graft(Result)
deconstruct_brep = DeconstructBrep(Brep=solid_union)  # -> Faces, Edges, Vertices
area_47 = Area(Geometry=deconstruct_brep.Faces)  # -> Area, Centroid
deconstruct = Deconstruct(Point=area_47.Centroid)  # -> XComponent, YComponent, ZComponent
sort_list = SortList(Keys=deconstruct.ZComponent, ValuesValuesA=deconstruct_brep.Faces)  # -> Keys, ValuesValuesA
cull_index = CullIndex(List=sort_list.ValuesValuesA, Indices="0", Wrap=True)  # -> flatten(List)
area_48 = Area(Geometry=cull_index)  # -> Area, Centroid
volume = Volume(Geometry=flatten(solid_union))  # -> Volume, Centroid
mass_addition_2 = MassAddition(Input=area_48.Area)  # -> Result, PartialResults
mass_addition_3 = MassAddition(Input=volume.Volume)  # -> Result, PartialResults
division_23 = Division(A=mass_addition_2.Result, B=mass_addition_3.Result)
# 体形系数
panel_95 = Panel(division_23)

bounding_box = BoundingBox(Content=extr_3, Plane=PlaneXY(0, 0, 0))  # -> Box, Box_2
bounding_box_2 = BoundingBox(Content=extr_2, Plane=PlaneXY(0, 0, 0))  # -> Box, Box_2
deconstruct_brep_2 = DeconstructBrep(Brep=bounding_box.Box)  # -> Faces, Edges, Vertices
deconstruct_brep_3 = DeconstructBrep(Brep=bounding_box_2.Box)  # -> Faces, Edges, Vertices
list_item = ListItem(List=deconstruct_brep_2.Faces, Index=Slider(5, range=0..10), Wrap=True)
list_item_2 = ListItem(List=deconstruct_brep_3.Faces, Index=Slider(5, range=0..10), Wrap=True)
area_49 = Area(Geometry=list_item)  # -> Area, Centroid
area_50 = Area(Geometry=list_item_2)  # -> Area, Centroid
project = Project(Geometry=area_49.Centroid, Plane=PlaneXY(0, 0, 0))  # -> Geometry, Transform
project_2 = Project(Geometry=area_50.Centroid, Plane=PlaneXY(0, 0, 0))  # -> Geometry, Transform
distance = Distance(PointA=area_49.Centroid, PointB=project.Geometry)  # -> flatten(Distance)
distance_2 = Distance(PointA=area_50.Centroid, PointB=project_2.Geometry)  # -> flatten(Distance)
merge_20 = Merge(Data1=distance, Data2=distance_2)
average = Average(Input=[distance, distance_2])
subtraction_24 = Subtraction(A=merge_20, B=average)  # -> graft(Result)
multiplication_17 = Multiplication(A=subtraction_24, B=subtraction_24)  # -> flatten(Result)
mass_addition_4 = MassAddition(Input=multiplication_17)  # -> Result, PartialResults
list_length = ListLength(List=multiplication_17)
# 平均高度和标准差
division_24 = Division(A=mass_addition_4.Result, B=list_length)
square_root = SquareRoot(Value=division_24)

# ----
# 街道高宽比
division_25 = Division(A=average, B=multiplication_6)

# ----
# 街道高宽比
multiplication_18 = Multiplication(A=random_4, B="2")
division_26 = Division(A=average, B=multiplication_18)

filter_5 = StreamFilter(Gate=list, Stream1=move_5.Geometry)

# ----
# 綠植
filter_6 = StreamFilter(Gate=list, Stream1=boundary_20)

filter_7 = StreamFilter(Gate=list, Stream1=addition_13)

# ----
# 街廓
filter_8 = StreamFilter(Gate=list, Stream1=boundary_19)

# ----
# 樓層
filter_9 = StreamFilter(Gate=list, Stream1=merge_18)

# ----
# 容積率
filter_10 = StreamFilter(Gate=list, Stream1=panel_94)

# ----
# 建蔽率
filter_11 = StreamFilter(Gate=list, Stream1=panel_87)

# ----
# 結果容積率
# 結果建築密度
panel_96 = Panel(filter_10)
panel_97 = Panel(filter_11)

# ----
# 建築
filter_12 = StreamFilter(Gate=list, Stream1=extr_3)

# ----
# 底層
filter_13 = StreamFilter(Gate=list, Stream1=extr_2)

panel_98 = Panel(filter_10)
panel_99 = Panel(filter_11)
brep_44 = Brep(filter_13)
crv_59 = Curve(simplify(flatten(filter_9)))
brep_45 = Brep(flatten([filter_12, brep_44]))
brep_46 = Brep(filter_6)
brep_47 = Brep(filter_8)
edges_11 = BrepEdges(Brep=brep_45)  # -> Naked, Interior, NonManifold
edges_12 = BrepEdges(Brep=brep_46)  # -> Naked, Interior, NonManifold
edges_13 = BrepEdges(Brep=brep_47)  # -> Naked, Interior, NonManifold
move_8 = Move(Geometry=brep_45, Motion=X)  # -> Geometry, Transform
previewlw = CustomPreviewLineweights(Geometry=crv_59, Shader=ColourSwatch(SwatchColor=RGB(130, 130, 130)), Absolute=False)
tag_2 = TextTag3D(
    Location=filter_5,
    Text=filter_7,
    Size=Slider(11, range=0..100),
    Colour=ColourSwatch(SwatchColor=RGB(0, 0, 0)),
    Justification=5)
preview_2 = CustomPreview(Geometry=brep_45, Material=ColourSwatch(SwatchColor=RGBA(255, 255, 255, 160)))
preview_3 = CustomPreview(Geometry=brep_47, Material=ColourSwatch(SwatchColor=RGB(199, 199, 199)))
previewlw_2 = CustomPreviewLineweights(Geometry=edges_11.Interior, Shader=ColourSwatch(SwatchColor=RGB(0, 0, 0)), Absolute=False)
preview_4 = CustomPreview(Geometry=brep_46, Material=ColourSwatch(SwatchColor=RGB(188, 255, 173)))
preview_5 = CustomPreview(Geometry=brep_44, Material=ColourSwatch(SwatchColor=RGBA(74, 35, 35, 117)))
previewlw_3 = CustomPreviewLineweights(Geometry=[edges_13.Naked, edges_12.Naked], Shader=ColourSwatch(SwatchColor=RGB(0, 0, 0)), Absolute=False)

# ---- group: 高层
brep_48 = Brep(brep_45)  # disabled

# ----
brep_49 = Brep(brep_45)
merge_21 = Merge(Data1=brep_48)  # -> flatten(Result); disabled
list_length_2 = ListLength(List=flatten(merge_21))  # disabled
list_length_3 = ListLength(List=flatten(merge_21))  # disabled
multiplication_19 = Multiplication(A=list_length_3, B=random_6)  # disabled
multiplication_20 = Multiplication(A=list_length_2, B=random_5)  # disabled
split_list = SplitList(List=merge_21, Index=multiplication_19)  # -> ListA, ListB; disabled
split_list_2 = SplitList(List=split_list.ListB, Index=multiplication_20)  # -> ListA, ListB; disabled

# ---- group: 住宅
brep_50 = Brep(split_list_2.ListB)  # disabled

# ---- group: 办公
brep_51 = Brep(split_list_2.ListA)  # disabled

# ---- group: 商业
brep_52 = Brep(split_list.ListA)  # disabled

# ----
mesh_2 = MeshBrep(Brep=brep_49, Settings=custom_mesh_settings_2)
sunlighthoursanalysis = Ladybug_SunlightHoursAnalysis(
    geometry=flatten(entwine_2),
    context=flatten(mesh_2),
    gridSize=Slider(7, range=0..10),
    disFromBase=Slider(0.01, range=0..0.01),
    sunVectors=flatten(sunpath.sunVectors),
    timeStep=1,
    legendPar=flatten(legendpar),
    runIt=Toggle(True))  # -> readMe, contextMesh, analysisMesh, testPts, testVec, port, sunlightHoursResult, sunlightHoursMesh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; plug-in component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

# ----
# Create Office Buildings
panel_100 = Panel("OfficeBldg")  # disabled
officesolids = Geometry(brep_51)  # disabled
panel_101 = Panel("@4")  # disabled
toggle_8 = BooleanToggle(True)  # disabled
buildingsolid = DFBuildingFromSolid(
    bldg_geo=flatten(officesolids),
    floor_to_floor=panel_101,
    name=panel_100,
    program=blendprograms,
    constr_set=constrsetclimate,
    run=toggle_8)  # -> report, buildings; disabled; plug-in component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
number_slider_32 = Slider(0.5, range=0..1)  # disabled
simpleratiopar = DFSimpleWindowRatioParameters(ratio=number_slider_32)  # -> win_par; disabled; plug-in component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
applyfacadepar = DFApplyFacadeParameters(df_obj=flatten(buildingsolid.buildings), win_par=simpleratiopar)  # -> out, df_obj; disabled; plug-in component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

# ----
# Create Residential Buildings
panel_102 = Panel("2013::MidriseApartment::Apartment")  # disabled
residentialsolids = Geometry(brep_50)  # disabled
panel_103 = Panel("ResidentialBldg")  # disabled
toggle_9 = BooleanToggle(True)  # disabled
panel_104 = Panel("@4")  # disabled
buildingsolid_2 = DFBuildingFromSolid(
    bldg_geo=flatten(residentialsolids),
    floor_to_floor=panel_104,
    name=panel_103,
    program=panel_102,
    constr_set=constrsetclimate,
    run=toggle_9)  # -> report, buildings; disabled; plug-in component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
panel_105 = Panel("0.3")  # disabled
simpleratiopar_2 = DFSimpleWindowRatioParameters(ratio=panel_105)  # -> win_par; disabled; plug-in component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
applyfacadepar_2 = DFApplyFacadeParameters(df_obj=flatten(buildingsolid_2.buildings), win_par=simpleratiopar_2)  # -> report, df_obj; disabled; plug-in component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

# ----
# Create Retail Buildings
panel_106 = Panel("RetailBldg")  # disabled
officesolids_2 = Geometry(brep_52)  # disabled
panel_107 = Panel("@4")  # disabled
toggle_10 = BooleanToggle(True)  # disabled
buildingsolid_3 = DFBuildingFromSolid(
    bldg_geo=flatten(officesolids_2),
    floor_to_floor=panel_107,
    name=panel_106,
    program=hb_building_programs,
    constr_set=constrsetclimate,
    run=toggle_10)  # -> report, buildings; disabled; plug-in component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
number_slider_33 = Slider(0.5, range=0..1)  # disabled
simpleratiopar_3 = DFSimpleWindowRatioParameters(ratio=number_slider_33)  # -> win_par; disabled; plug-in component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
applyfacadepar_3 = DFApplyFacadeParameters(df_obj=flatten(buildingsolid_3.buildings), win_par=simpleratiopar_3)  # -> out, df_obj; disabled; plug-in component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

panel_108 = Panel(sunlighthoursanalysis.totalSunlightHours)
pt_6 = Point(sunlighthoursanalysis.testPts)
mesh_3 = Mesh(sunlighthoursanalysis.sunlightHoursMesh)
branch_16 = TreeBranch(Tree=sunlighthoursanalysis.sunlightHoursResult, Path="0", MaintainPaths=True)
branch_17 = TreeBranch(Tree=pt_6, Path="0", MaintainPaths=True)
datarec_boolean_7 = DataRecBoolean(d=panel_108, reset=Toggle(False))  # -> out, A; inputs d: tree; same code as datarec_boolean
panel_109 = Panel(datarec_boolean_7.A)
panel_110 = Panel(branch_16)
brep_53 = Brep(brep_49)
visibilitypercent = LBVisibilityPercent(view_points=duppt, geometry=flatten(brep_49), grid_size="8", run=Toggle(True))  # -> report, points, results, mesh, legend, title, int_mtx; plug-in component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

# ---- group: test geometry
brep_54 = Brep(brep_53)

# ----
brep_55 = Brep(flatten(brep_45))
larger_3 = LargerThan(FirstNumber=visibilitypercent.results, SecondNumber=Slider(19, range=0..100))  # -> LargerThan, OrEqualTo
explode_8 = MeshExplode(Mesh=visibilitypercent.mesh, Interpolate=False)
avr = Average(Input=visibilitypercent.results)
radiationanalysis = Ladybug_RadiationAnalysis(
    geometry=flatten(brep_54),
    gridSize="10",
    disFromBase=".01",
    selectedSkyMtx=flatten(selectskymtx.selectedSkyMtx),
    parallel=toggle_4,
    runIt=toggle_4)  # -> readMe, contextMesh, analysisMesh, testPts, testVec, port, radiationResult, radiationMesh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; plug-in component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
python_3 = PythonScript(pts=move.Geometry, breps=brep_55)  # -> out, inside, ids; inputs pts: list of Point3d, breps: list of Brep
# ---------- python_3: Python ----------
import rhinoscriptsyntax as rs
import Rhino.Geometry as rg

inside = []
ids = []
id = 0
for i in pts:
    id += 1
    for j in breps:
        a = j.IsPointInside(i, 0.01, True)
        if a:
            inside.append(i)
            ids.append(id)
# ---------- end python_3 ----------
dispatch_33 = Dispatch(List=explode_8, DispatchPattern=larger_3.LargerThan)  # -> ListA, ListB
panel_111 = Panel(avr)
mesh_4 = Mesh(dispatch_33.ListB)
panel_112 = Panel(visibilitypercent.results)
pt_7 = Point(python_3.inside)
merge_22 = Merge(Data1=applyfacadepar.df_obj, Data2=applyfacadepar_3.df_obj, Data3=applyfacadepar_2.df_obj)  # disabled
subtraction_25 = Subtraction(A=python_3.ids, B="1")
panel_113 = Panel(radiationanalysis.totalRadiation)
replace_7 = ReplaceItems(List=repeat, Item="1", Indices=subtraction_25, Wrap=False)
all_buildings = Data(flatten(merge_22))  # disabled

# ----
# Create Dragonfly  Model
panel_114 = Panel("ParkingStructure")  # disabled
contextshade = Geometry([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])  # disabled
context = DFContextShade(geo=contextshade, name=panel_114)  # -> report, context; disabled; plug-in component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
panel_115 = Panel("DF2021")  # disabled
model = DFModel(buildings=flatten(all_buildings), context=flatten(context.context), name=panel_115)  # -> report, model; disabled; plug-in component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

dispatch_34 = Dispatch(List=move.Geometry, DispatchPattern=replace_7)  # -> ListA, ListB
pt_8 = Point(dispatch_34.ListA)
box_2 = CenterBox(Base=pt_8, X=dom_3, Y=dom_3, Z=dom_3)
panel_116 = Panel(replace_7)

roomenergyattr = HBRoomEnergyAttributes({"Program": "properties.energy.program_type.display_name", "Construction Set": "properties.energy.construction_set.display_name", "Is Conditioned": "properties.energy.is_conditioned", "People per Area [ppl/m2]": "properties.energy.people.people_per_area", "Area per Person [m2/ppl]": "properties.energy.people.area_per_person", "Lighting per Area [W/m2]": "properties.energy.lighting.watts_per_area", "Electric Equipment per Area [W/m2]": "properties.energy.electric_equipment.watts_per_area", "Gas Equipment per Area [W/m2]": "properties.energy.gas_equipment.watts_per_area", "Hot Water per Area [L/h-m2]": "properties.energy.service_hot_water.flow_per_area", "Infiltration per Exterior Area [m3/s-m2]": "properties.energy.infiltration.flow_per_exterior_area"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}, selected="Program")  # disabled
colorroom2dattr = DFColorRoom2DAttributes(df_obj=flatten(model.model), attribute=roomenergyattr)  # -> mesh, legend, wire_frame, values, colors; disabled; plug-in component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

# ---- group: model_bool
bool_4 = Number(replace_7)

# ----
tstat_26 = TreeStatistics(Tree=bool_4)  # -> Paths, Length, Count
replace_8 = ReplacePaths(Data=bool_4, Search=tstat_26.Paths, Replace=path_3)
datarec_boolean_8 = DataRecBoolean(d=replace_8, reset=Toggle(False))  # -> out, A; inputs d: tree; same code as datarec_boolean
lng_29 = ListLength(List=datarec_boolean_8.A)
panel_117 = Panel(lng_29)

# ---- group: average_sunhour
num_18 = Number(sunlighthoursanalysis.totalSunlightHours)

# ---- group: average visibilty
num_19 = Number(avr)

# ---- group: total radiation
num_20 = Number(radiationanalysis.totalRadiation)

# ----
# Export
# OSW Files
# Option 2: Run Models with OpenStudio
dragonfly_model = Data(model.model)  # disabled

# ----
# Translate to Honeybee
toggle_11 = BooleanToggle(True)  # disabled
# 1
# Translate Models
# to Honeybee
panel_118 = Panel("50")  # disabled
tohoneybee = DFModelToHoneybee(model=dragonfly_model, use_multiplier=toggle_11, shade_dist=panel_118, run=bool)  # -> report, hb_models; disabled; plug-in component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
toggle_12 = BooleanToggle(False)  # disabled

entwine_6 = Entwine(Branch00=num_18, Branch01=num_20, Branch02=num_19, FlattenInputs=True)  # -> flatten(Result)
tstat_27 = TreeStatistics(Tree=bool_4)  # -> Paths, Length, Count
tstat_28 = TreeStatistics(Tree=entwine_6)  # -> Paths, Length, Count
replace_9 = ReplacePaths(Data=entwine_6, Search=tstat_28.Paths, Replace=path_3)
replace_10 = ReplacePaths(Data=bool_4, Search=tstat_27.Paths, Replace=path_3)

# ----
# Export to OpenStudio
modeltoosm = HBModelToOSM(model=tohoneybee.hb_models, epw_file=downloadepw.epw_file, sim_par=simpar, write=bool)  # -> report, jsons, osw, osm, idf, sql, zsz, rdd, html; disabled; plug-in component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

datarec_boolean_9 = DataRecBoolean(d=replace_10, reset=toggle)  # -> out, A; inputs d: tree; same code as datarec_boolean
panel_119 = Panel(replace_9)
datarec_boolean_10 = DataRecBoolean(d=replace_9, reset=toggle)  # -> out, A; inputs d: tree; same code as datarec_boolean
split_7 = SplitList(List=reverse(datarec_boolean_9.A), Index=lng_5)  # -> reverse(ListA), ListB
split_8 = SplitList(List=reverse(datarec_boolean_10.A), Index="3")  # -> reverse(ListA), ListB

number_slider_34 = Slider(0, range=0..30)  # disabled
hb_room_attributes = HBRoomAttributes({"Display Name": "display_name", "Simulation Name (Identifier)": "identifier", "Multiplier": "multiplier", "Story": "story", "Volume": "volume", "Gross Floor Area": "floor_area", "Exposed Area": "exposed_area", "Exterior Wall Area": "exterior_wall_area", "Exterior Aperture Area": "exterior_aperture_area", "Average Floor Elevation": "average_floor_height"}, selected="Story")  # disabled
list_item_3 = ListItem(List=tohoneybee.hb_models, Index=number_slider_34, Wrap=True)  # disabled
colorroomattr = HBColorRoomAttributes(rooms_model=flatten(list_item_3), attribute=hb_room_attributes)  # -> mesh, legend, wire_frame, values, colors; disabled; plug-in component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
facesbytype = HBFacesByType(hb_objs=list_item_3)  # -> walls, interior_walls, roofs, ceilings, exterior_floors, interior_floors, air_walls, apertures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; disabled; plug-in component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
vizall = HBVizualizeAll(hb_objs=flatten(facesbytype.outdoor_shades))  # -> geo; disabled; plug-in component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
vizwiref = HBVizualizeWireframe(hb_objs=flatten(tohoneybee.hb_models))  # -> geo; disabled; plug-in component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

trim = TrimTree(Tree=split_8.ListA, Depth=1)
panel_120 = Panel(trim)

# ----
# Run Simulations
# 3
# Run OSWs
# and Simulation
# in Parallel
runosw = HBRunOSW(osw=modeltoosm.osw, epw_file=downloadepw.epw_file, translate=bool, run=bool)  # -> report, osm, idf, sql, zsz, rdd, html; disabled; plug-in component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

bang_2 = ExplodeTree(Data=split_7.ListA)  # -> Branch0, Branch1, Branch2, Branch3, Branch4, Branch5; disabled
tstat_29 = TreeStatistics(Tree=split_7.ListA)  # -> Paths, Length, Count
tstat_30 = TreeStatistics(Tree=trim)  # -> Paths, Length, Count
dispatch_35 = Dispatch(List=move.Geometry, DispatchPattern=bang_2.Branch5)  # -> ListA, ListB; disabled
eui = HBEndUseIntensity(sql=runosw.sql)  # -> eui, eui_end_use, end_uses, gross_floor; disabled; plug-in component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
pt_9 = Point(dispatch_35.ListA)  # disabled
replace_11 = ReplacePaths(Data=split_7.ListA, Search=tstat_29.Paths, Replace=tstat_30.Paths)
multiplication_21 = Multiplication(A=eui.eui, B=eui.gross_floor)  # disabled
merge_23 = Merge(Data1=simplify(replace_11), Data2=simplify(trim))

tstat_31 = TreeStatistics(Tree=square_root)  # -> Paths, Length, Count; disabled
panel_121 = Panel("{0}")  # disabled
replace_12 = ReplacePaths(Data=square_root, Search=tstat_31.Paths, Replace=panel_121)  # disabled
clean_20 = CleanTree(RemoveNulls=True, RemoveInvalid=True, RemoveEmpty=False, Tree=replace_12)  # disabled

tstat_32 = TreeStatistics(Tree=panel_96)  # -> Paths, Length, Count; disabled
panel_122 = Panel("{0}")  # disabled
replace_13 = ReplacePaths(Data=panel_96, Search=tstat_32.Paths, Replace=panel_122)  # disabled
clean_21 = CleanTree(RemoveNulls=True, RemoveInvalid=True, RemoveEmpty=False, Tree=replace_13)  # disabled

mass_addition_5 = MassAddition(Input=multiplication_21)  # -> Result, PartialResults; disabled
split_9 = SplitList(List=reverse(merge_23), Index=Slider(16100, range=0..100000))  # -> reverse(simplify(ListA)), ListB
flip_6 = FlipMatrix(Data=merge_23)
panel_123 = Panel(mass_addition_5.Result)  # disabled
data = Data(mass_addition_5.Result)  # disabled
number_15 = Number(mass_addition_5.Result)  # disabled
bang_3 = ExplodeTree(Data=merge_23)
panel_124 = Panel(flip_6)
lng_30 = ListLength(List=flatten(bang_3))
subtraction_26 = Subtraction(A=lng_30, B="3")
series_9 = Series(Start=0, Step=1, Count=subtraction_26)
# 总能耗
datarec_boolean_11 = DataRecBoolean(d=panel_123, reset=bool_2)  # -> out, A; inputs d: tree; disabled; same code as datarec_boolean
# 容积率
datarec_boolean_12 = DataRecBoolean(d=clean_21, reset=bool_2)  # -> out, A; inputs d: tree; disabled; same code as datarec_boolean
# 平均高度
datarec_boolean_13 = DataRecBoolean(d=average, reset=bool_2)  # -> out, A; inputs d: tree; disabled; same code as datarec_boolean
# 平均街道高宽比H/W
datarec_boolean_14 = DataRecBoolean(d=division_26, reset=bool_2)  # -> out, A; inputs d: tree; disabled; same code as datarec_boolean
# 体形系数
datarec_boolean_15 = DataRecBoolean(d=division_23, reset=bool_2)  # -> out, A; inputs d: tree; disabled; same code as datarec_boolean
# 建筑密度
datarec_boolean_16 = DataRecBoolean(d=panel_97, reset=bool_2)  # -> out, A; inputs d: tree; disabled; same code as datarec_boolean
# 高度标准差
datarec_boolean_17 = DataRecBoolean(d=clean_20, reset=bool_2)  # -> out, A; inputs d: tree; disabled; same code as datarec_boolean

# ----
# 光伏板能耗计算
data_2 = Data(simplify(graft(tohoneybee.hb_models)))  # disabled
facesbytype_2 = HBFacesByType(hb_objs=data_2)  # -> walls, interior_walls, roofs, ceilings, exterior_floors, interior_floors, air_walls, apertures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; disabled; plug-in component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
list_item_4 = ListItem(List=facesbytype_2.ceilings, Index=0, Wrap=True)  # disabled
vizall_2 = HBVizualizeAll(hb_objs=flatten(list_item_4))  # -> geo; disabled; plug-in component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
area_51 = Area(Geometry=vizall_2)  # -> Area, Centroid; disabled
mass_addition_6 = MassAddition(Input=area_51.Area)  # -> Result, PartialResults; disabled
multiplication_22 = Multiplication(A=mass_addition_6.Result, B=number_slider_26)  # disabled

repeat_17 = RepeatData(Data="id_", Length=subtraction_26)
merge_24 = Merge(Data1=graft(repeat_17), Data2=graft(series_9))
panel_125 = Panel(datarec_boolean_15.A)  # disabled
panel_126 = Panel(datarec_boolean_14.A)  # disabled
panel_127 = Panel(datarec_boolean_17.A)  # disabled
panel_128 = Panel(datarec_boolean_12.A)  # disabled
panel_129 = Panel(datarec_boolean_16.A)  # disabled
panel_130 = Panel(datarec_boolean_13.A)  # disabled
join_25 = TextJoin(Text=merge_24)  # -> flatten(Result)
panel_131 = Panel(join_25)
entwine_7 = Entwine(Branch00=panel_131, Branch01="average_sun", Branch02="total_radiation", Branch03="visibility", FlattenInputs=True)  # -> flatten(Result)
tstat_33 = TreeStatistics(Tree=split_7.ListA)  # -> Paths, Length, Count
series_10 = Series(Start=0, Step=1, Count=tstat_33.Count)
equalst_2 = EqualityWithinTolerance(FirstNumber=multiplication_22, SecondNumber=number_slider_26, Tolerance=panel_47)  # -> Equality, Inequality; disabled
# 容积率
cluster_17 = Cluster_4(bool=bool_3, input=clean_21, iter=int_2, batch=number_slider_27)  # disabled
# 建筑密度
cluster_18 = Cluster_4(bool=bool_3, input=panel_97, iter=int_2, batch=number_slider_27)  # disabled
# 平均高度
cluster_19 = Cluster_4(bool=bool_3, input=average, iter=int_2, batch=number_slider_27)  # disabled
# 高度标准差
cluster_20 = Cluster_4(bool=bool_3, input=clean_20, iter=int_2, batch=number_slider_27)  # disabled
# 平均街道高宽比H/W
cluster_21 = Cluster_4(bool=bool_3, input=division_26, iter=int_2, batch=number_slider_27)  # disabled
# 体形系数
cluster_22 = Cluster_4(bool=bool_3, input=division_23, iter=int_2, batch=number_slider_27)  # disabled

row_start_2 = Slider(1, range=1..40)
column_start_2 = Slider(1, range=1..40)
wo_2 = WriteOptions(
    ClearDataOverwrite=True,
    SaveAfterWrite=False,
    CloseAfterWrite=False,
    ColumnStartPosition=column_start_2,
    RowStartPosition=row_start_2)  # -> UserMessages, WriteOptions
writexl_2 = WriteToExcel(
    Run=Toggle(False),
    ExcelWorksheet="1",
    ColumnNames=entwine_7,
    RowNames=series_10,
    WriteOptions=wo_2.WriteOptions,
    ColumnnsOrRows=False,
    DataToWriteIntoColumns=flip_6)

# ----
# 总能耗
cluster_23 = Cluster_4(bool=bool_3, input=panel_123, iter=int_2, batch=number_slider_27)  # disabled
dispatch_36 = Dispatch(List=multiplication_22, DispatchPattern=equalst_2.Equality)  # -> ListA, ListB; disabled
# 总光伏发电量
datarec_boolean_18 = DataRecBoolean(d=dispatch_36.ListB, reset=bool_2)  # -> out, A; inputs d: tree; disabled; same code as datarec_boolean

# ---- group: 考虑光伏后的总能耗
subtraction_27 = Subtraction(A=data, B=dispatch_36.ListB)  # disabled
with_pv = Data(subtraction_27)  # disabled

# ----
# 净能耗
datarec_boolean_19 = DataRecBoolean(d=with_pv, reset=bool_2)  # -> out, A; inputs d: tree; disabled; same code as datarec_boolean
# 总光伏发电量
cluster_24 = Cluster_4(bool=bool_3, input=dispatch_36.ListB, iter=int_2, batch=number_slider_27)  # disabled
# 净能耗
cluster_25 = Cluster_4(bool=bool_3, input=with_pv, iter=int_2, batch=number_slider_27)  # disabled

tstat_34 = TreeStatistics(Tree=number_11)  # -> Paths, Length, Count; disabled
tstat_35 = TreeStatistics(Tree=number_12)  # -> Paths, Length, Count; disabled
tstat_36 = TreeStatistics(Tree=number_10)  # -> Paths, Length, Count; disabled
tstat_37 = TreeStatistics(Tree=number_13)  # -> Paths, Length, Count; disabled
tstat_38 = TreeStatistics(Tree=number_14)  # -> Paths, Length, Count; disabled
panel_132 = Panel("187.5")  # disabled
item_49 = ListItem(List=tstat_34.Paths, Index=0, Wrap=True)  # disabled
item_50 = ListItem(List=tstat_35.Paths, Index=0, Wrap=True)  # disabled
item_51 = ListItem(List=tstat_36.Paths, Index=0, Wrap=True)  # disabled
item_52 = ListItem(List=tstat_37.Paths, Index=0, Wrap=True)  # disabled
item_53 = ListItem(List=tstat_38.Paths, Index=0, Wrap=True)  # disabled
equalst_3 = EqualityWithinTolerance(FirstNumber=number, SecondNumber=panel_132, Tolerance=0.001)  # -> Equality, Inequality; disabled
split_10 = SplitTree(Data=number_11, Masks=flatten(item_49))  # -> Positive, Negative; disabled
split_11 = SplitTree(Data=number_12, Masks=flatten(item_50))  # -> Positive, Negative; disabled
split_12 = SplitTree(Data=number_10, Masks=flatten(item_51))  # -> Positive, Negative; disabled
split_13 = SplitTree(Data=number_13, Masks=flatten(item_52))  # -> Positive, Negative; disabled
split_14 = SplitTree(Data=number_14, Masks=flatten(item_53))  # -> Positive, Negative; disabled
dispatch_37 = Dispatch(List=number, DispatchPattern=equalst_3.Equality)  # -> ListA, ListB; disabled
panel_133 = Panel("0")  # disabled
panel_134 = Panel("0")  # disabled
panel_135 = Panel("0")  # disabled
panel_136 = Panel("0")  # disabled
panel_137 = Panel("0")  # disabled
lng_31 = ListLength(List=dispatch_37.ListB)  # disabled
cull_i_6 = CullIndex(List=split_10.Positive, Indices=panel_133, Wrap=True)  # -> flatten(List); disabled
cull_i_7 = CullIndex(List=split_11.Positive, Indices=panel_134, Wrap=True)  # -> flatten(List); disabled
cull_i_8 = CullIndex(List=split_12.Positive, Indices=panel_135, Wrap=True)  # -> flatten(List); disabled
panel_138 = Panel("5")  # disabled
cull_i_9 = CullIndex(List=split_13.Positive, Indices=panel_136, Wrap=True)  # -> flatten(List); disabled
cull_i_10 = CullIndex(List=split_14.Positive, Indices=panel_137, Wrap=True)  # -> flatten(List); disabled
tstat_39 = TreeStatistics(Tree=number_2)  # -> Paths, Length, Count; disabled
equals_12 = Equality(FirstNumber=lng_31, SecondNumber=panel_138)  # -> flatten(Equality), Inequality; disabled
merge_25 = Merge(Data1=cull_i_6, Data2=simplify(split_10.Negative))  # disabled
merge_26 = Merge(Data1=cull_i_7, Data2=simplify(split_11.Negative))  # disabled
merge_27 = Merge(Data1=cull_i_8, Data2=simplify(split_12.Negative))  # disabled
merge_28 = Merge(Data1=cull_i_9, Data2=simplify(split_13.Negative))  # disabled
merge_29 = Merge(Data1=cull_i_10, Data2=simplify(split_14.Negative))  # disabled
dispatch_38 = Dispatch(List=tstat_39.Paths, DispatchPattern=equals_12.Equality)  # -> ListA, ListB; disabled
branch_18 = TreeBranch(Tree=dispatch_37.ListB, Path=dispatch_38.ListA, MaintainPaths=True)  # disabled
panel_139 = Panel("0")  # disabled
panel_140 = Panel("0")  # disabled
panel_141 = Panel("0")  # disabled
panel_142 = Panel("0")  # disabled
panel_143 = Panel("0")  # disabled
prepend_element = PrependElement(Data=merge_25, Index=panel_139)  # disabled
prepend_element_2 = PrependElement(Data=merge_26, Index=panel_140)  # disabled
prepend_element_3 = PrependElement(Data=merge_27, Index=panel_141)  # disabled
prepend_element_4 = PrependElement(Data=merge_28, Index=panel_142)  # disabled
prepend_element_5 = PrependElement(Data=merge_29, Index=panel_143)  # disabled
branch_19 = TreeBranch(Tree=number_5, Path=dispatch_38.ListA, MaintainPaths=True)  # disabled
branch_20 = TreeBranch(Tree=number_4, Path=dispatch_38.ListA, MaintainPaths=True)  # disabled
branch_21 = TreeBranch(Tree=number_2, Path=dispatch_38.ListA, MaintainPaths=True)  # disabled
branch_22 = TreeBranch(Tree=number_8, Path=dispatch_38.ListA, MaintainPaths=True)  # disabled
branch_23 = TreeBranch(Tree=number_6, Path=dispatch_38.ListA, MaintainPaths=True)  # disabled
branch_24 = TreeBranch(Tree=number_3, Path=dispatch_38.ListA, MaintainPaths=True)  # disabled
branch_25 = TreeBranch(Tree=number_7, Path=dispatch_38.ListA, MaintainPaths=True)  # disabled
branch_26 = TreeBranch(Tree=number_9, Path=dispatch_38.ListA, MaintainPaths=True)  # disabled
branch_27 = TreeBranch(Tree=prepend_element, Path=dispatch_38.ListA, MaintainPaths=True)  # disabled
branch_28 = TreeBranch(Tree=prepend_element_2, Path=dispatch_38.ListA, MaintainPaths=True)  # disabled
branch_29 = TreeBranch(Tree=prepend_element_3, Path=dispatch_38.ListA, MaintainPaths=True)  # disabled
branch_30 = TreeBranch(Tree=prepend_element_4, Path=dispatch_38.ListA, MaintainPaths=True)  # disabled
branch_31 = TreeBranch(Tree=prepend_element_5, Path=dispatch_38.ListA, MaintainPaths=True)  # disabled
panel_144 = Panel("""净能耗
总能耗
总光伏发电量
容积率
建筑密度
平均高度
高度标准差
平均街道高宽比H/W
体形系数
朝向
办公
商业
住宅
Seed""")  # disabled
toggle_13 = BooleanToggle(False)  # disabled

number_16 = Number(branch_31)  # disabled
number_17 = Number(branch_18)  # disabled
number_18 = Number(branch_21)  # disabled
number_19 = Number(branch_24)  # disabled
number_20 = Number(branch_20)  # disabled
number_21 = Number(branch_19)  # disabled
number_22 = Number(branch_23)  # disabled
number_23 = Number(branch_25)  # disabled
number_24 = Number(branch_22)  # disabled
number_25 = Number(branch_26)  # disabled
number_26 = Number(branch_29)  # disabled
number_27 = Number(branch_27)  # disabled
number_28 = Number(branch_28)  # disabled
number_29 = Number(branch_30)  # disabled

flatten_3 = FlattenTree(Tree=number_22, Path="{0}")  # disabled
flatten_4 = FlattenTree(Tree=number_20, Path="{0}")  # disabled
flatten_5 = FlattenTree(Tree=number_21, Path="{0}")  # disabled
flatten_6 = FlattenTree(Tree=number_17, Path="{0}")  # disabled
flatten_7 = FlattenTree(Tree=number_19, Path="{0}")  # disabled
flatten_8 = FlattenTree(Tree=number_18, Path="{0}")  # disabled
flatten_9 = FlattenTree(Tree=number_23, Path="{0}")  # disabled
flatten_10 = FlattenTree(Tree=number_24, Path="{0}")  # disabled
flatten_11 = FlattenTree(Tree=number_29, Path="{0}")  # disabled
flatten_12 = FlattenTree(Tree=number_16, Path="{0}")  # disabled
flatten_13 = FlattenTree(Tree=number_25, Path="{0}")  # disabled
flatten_14 = FlattenTree(Tree=number_26, Path="{0}")  # disabled
flatten_15 = FlattenTree(Tree=number_27, Path="{0}")  # disabled
flatten_16 = FlattenTree(Tree=number_28, Path="{0}")  # disabled
panel_145 = Panel(flatten_6)  # disabled
entwine_8 = Entwine(
    Branch00=flatten_6,
    Branch01=flatten_8,
    Branch02=flatten_7,
    Branch03=flatten_4,
    Branch04=flatten_5,
    Branch05=flatten_3,
    Branch06=flatten_9,
    Branch07=flatten_10,
    Branch08=flatten_13,
    Branch09=flatten_14,
    Branch010=flatten_15,
    Branch011=flatten_16,
    Branch012=flatten_11,
    Branch013=flatten_12,
    FlattenInputs=True)  # disabled
lng_32 = ListLength(List=flatten_6)  # disabled
series_11 = Series(Start=0, Step=1, Count=lng_32)  # disabled

column_start_3 = Slider(1, range=1..40)  # disabled
row_start_3 = Slider(1, range=1..40)  # disabled
wo_3 = WriteOptions(
    ClearDataOverwrite=True,
    SaveAfterWrite=False,
    CloseAfterWrite=False,
    ColumnStartPosition=column_start_3,
    RowStartPosition=row_start_3)  # -> UserMessages, WriteOptions; disabled
writexl_3 = WriteToExcel(
    Run=toggle_13,
    ExcelWorksheet="1",
    ColumnNames=panel_144,
    RowNames=series_11,
    WriteOptions=wo_3.WriteOptions,
    ColumnnsOrRows=False,
    DataToWriteIntoColumns=entwine_8)  # disabled

# ==== cluster Cluster
obj = ClusterInput()
plane = ClusterInput()
bbox = BoundingBox(Content=obj, Plane=plane, UnionBox=True)  # -> Box, Box_2
debrep = DeconstructBrep(Brep=bbox.Box)  # -> Faces, Edges, Vertices
dupln = RemoveDuplicateLines(Lines=debrep.Edges, Tolerance=0.01)
panel = Panel(dupln)
area = Area(Geometry=debrep.Faces)  # -> Area, Centroid
len = Length(Curve=dupln)
sort = SortList(Keys=area.Area, ValuesA=debrep.Faces)  # -> Keys, ValuesA
smaller = SmallerThan(FirstNumber=len, SecondNumber="1")  # -> SmallerThan, OrEqualTo
item = ListItem(List=reverse(sort.ValuesA), Index=0, Wrap=True)
dispatch = Dispatch(List=dupln, DispatchPattern=smaller.SmallerThan)  # -> ListA, ListB
brep = ClusterOutput(item)
edge = ClusterOutput(dispatch.ListB)

# ==== cluster Cluster_2
data = ClusterInput()
data_2 = ClusterInput()
data_3 = Data(data)
data_4 = Data(data_2)
tstat = TreeStatistics(Tree=data_4)  # -> Paths, Length, Count
tstat_2 = TreeStatistics(Tree=data_3)  # -> Paths, Length, Count
replace = ReplacePaths(Data=data_3, Search=tstat_2.Paths, Replace=tstat.Paths)
D = ClusterOutput(replace)

# ==== cluster Cluster_3
data = ClusterInput()
data_2 = Data(data)
A = ClusterInput()
B = ClusterInput()
tstat = TreeStatistics(Tree=data_2)  # -> Paths, Length, Count
lng = ListLength(List=data_2)
dom = ConstructDomain(DomainStart=A, DomainEnd=B)
series = Series(Start=0, Step=1, Count=tstat.Count)
random = Random(Range=dom, Number=lng, Seed=expr("x+100", graft(series)))  # -> simplify(Random)
random_2 = Random(Range=dom, Number=lng, Seed=graft(series))  # -> simplify(Random)
neg = Negative(Value=random)
neg_2 = Negative(Value=random_2)
dom_2 = ConstructDomain(DomainStart=neg, DomainEnd=random)
dom_3 = ConstructDomain(DomainStart=neg_2, DomainEnd=random_2)
I = ClusterOutput(dom_2)
I_2 = ClusterOutput(dom_3)

# ==== cluster Cluster_4
batch = ClusterInput()
input = ClusterInput()
iter = ClusterInput()
series = Series(Start=0, Step=1, Count="25")
int = Integer(batch)
int_2 = Integer(iter)
num = Number(input)
dup = DuplicateData(Data=series, Number=int, Order=invert(True))
bool = ClusterInput()
item = ListItem(List=dup, Index=expr("x-1", int_2), Wrap=invert(True))
panel = Panel(item)
bool_2 = Boolean(bool)
gate = StreamGate(Stream=num, Gate=item)  # -> Target0, Target1, Target2, Target3, Target4, Target5, Target6, Target7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
datarec_boolean = DataRecBoolean(d=gate.Target20, reset=bool_2)  # -> out, A; inputs d: tree
# ---------- datarec_boolean: VB usings ----------
Imports System.IO
Imports System.Linq
Imports System.Data
Imports System.Drawing
Imports System.Reflection
Imports System.Windows.Forms
Imports System.Xml
Imports System.Xml.Linq
Imports Microsoft.VisualBasic
Imports System.Runtime.InteropServices

Imports Rhino.DocObjects
Imports Rhino.Collections
Imports GH_IO
Imports GH_IO.Serialization
# ---------- datarec_boolean: VB ----------
    If reset = True Then
      out_tree.clear
    Else
      For Each p As GH_Path In d.Paths
        Dim out_list As List(Of Object) = d.Branch(p)
        out_tree.AddRange(out_list, New GH_Path(p))
      Next

    End If

    A = out_tree
# ---------- datarec_boolean: VB additional code ----------
  Dim out_tree As New DataTree(Of Object)
# ---------- end datarec_boolean ----------
datarec_boolean_2 = DataRecBoolean(d=gate.Target21, reset=bool_2)  # -> out, A; inputs d: tree; same code as datarec_boolean
datarec_boolean_3 = DataRecBoolean(d=gate.Target22, reset=bool_2)  # -> out, A; inputs d: tree; same code as datarec_boolean
datarec_boolean_4 = DataRecBoolean(d=gate.Target23, reset=bool_2)  # -> out, A; inputs d: tree; same code as datarec_boolean
datarec_boolean_5 = DataRecBoolean(d=gate.Target24, reset=bool_2)  # -> out, A; inputs d: tree; same code as datarec_boolean
datarec_boolean_6 = DataRecBoolean(d=gate.Target0, reset=bool_2)  # -> out, A; inputs d: tree; same code as datarec_boolean
datarec_boolean_7 = DataRecBoolean(d=gate.Target1, reset=bool_2)  # -> out, A; inputs d: tree; same code as datarec_boolean
datarec_boolean_8 = DataRecBoolean(d=gate.Target2, reset=bool_2)  # -> out, A; inputs d: tree; same code as datarec_boolean
datarec_boolean_9 = DataRecBoolean(d=gate.Target3, reset=bool_2)  # -> out, A; inputs d: tree; same code as datarec_boolean
datarec_boolean_10 = DataRecBoolean(d=gate.Target4, reset=bool_2)  # -> out, A; inputs d: tree; same code as datarec_boolean
datarec_boolean_11 = DataRecBoolean(d=gate.Target5, reset=bool_2)  # -> out, A; inputs d: tree; same code as datarec_boolean
datarec_boolean_12 = DataRecBoolean(d=gate.Target6, reset=bool_2)  # -> out, A; inputs d: tree; same code as datarec_boolean
datarec_boolean_13 = DataRecBoolean(d=gate.Target7, reset=bool_2)  # -> out, A; inputs d: tree; same code as datarec_boolean
datarec_boolean_14 = DataRecBoolean(d=gate.Target8, reset=bool_2)  # -> out, A; inputs d: tree; same code as datarec_boolean
datarec_boolean_15 = DataRecBoolean(d=gate.Target9, reset=bool_2)  # -> out, A; inputs d: tree; same code as datarec_boolean
datarec_boolean_16 = DataRecBoolean(d=gate.Target10, reset=bool_2)  # -> out, A; inputs d: tree; same code as datarec_boolean
datarec_boolean_17 = DataRecBoolean(d=gate.Target11, reset=bool_2)  # -> out, A; inputs d: tree; same code as datarec_boolean
datarec_boolean_18 = DataRecBoolean(d=gate.Target12, reset=bool_2)  # -> out, A; inputs d: tree; same code as datarec_boolean
datarec_boolean_19 = DataRecBoolean(d=gate.Target13, reset=bool_2)  # -> out, A; inputs d: tree; same code as datarec_boolean
datarec_boolean_20 = DataRecBoolean(d=gate.Target14, reset=bool_2)  # -> out, A; inputs d: tree; same code as datarec_boolean
datarec_boolean_21 = DataRecBoolean(d=gate.Target15, reset=bool_2)  # -> out, A; inputs d: tree; same code as datarec_boolean
datarec_boolean_22 = DataRecBoolean(d=gate.Target16, reset=bool_2)  # -> out, A; inputs d: tree; same code as datarec_boolean
datarec_boolean_23 = DataRecBoolean(d=gate.Target17, reset=bool_2)  # -> out, A; inputs d: tree; same code as datarec_boolean
datarec_boolean_24 = DataRecBoolean(d=gate.Target18, reset=bool_2)  # -> out, A; inputs d: tree; same code as datarec_boolean
datarec_boolean_25 = DataRecBoolean(d=gate.Target19, reset=bool_2)  # -> out, A; inputs d: tree; same code as datarec_boolean
entwine = Entwine(
    Branch00=datarec_boolean_6.A,
    Branch01=datarec_boolean_7.A,
    Branch02=datarec_boolean_8.A,
    Branch03=datarec_boolean_9.A,
    Branch04=datarec_boolean_10.A,
    Branch05=datarec_boolean_11.A,
    Branch06=datarec_boolean_12.A,
    Branch07=datarec_boolean_13.A,
    Branch08=datarec_boolean_14.A,
    Branch09=datarec_boolean_15.A,
    Branch010=datarec_boolean_16.A,
    Branch011=datarec_boolean_17.A,
    Branch012=datarec_boolean_18.A,
    Branch013=datarec_boolean_19.A,
    Branch014=datarec_boolean_20.A,
    Branch015=datarec_boolean_21.A,
    Branch016=datarec_boolean_22.A,
    Branch017=datarec_boolean_23.A,
    Branch018=datarec_boolean_24.A,
    Branch019=datarec_boolean_25.A,
    Branch020=datarec_boolean.A,
    Branch021=datarec_boolean_2.A,
    Branch022=datarec_boolean_3.A,
    Branch023=datarec_boolean_4.A,
    Branch024=datarec_boolean_5.A,
    FlattenInputs=True)
clean = CleanTree(RemoveNulls=True, RemoveInvalid=True, RemoveEmpty=invert(False), Tree=entwine)
T = ClusterOutput(clean)
