# Grasshopper definition cpython_testing.gh (Grasshopper 1.0.7)
# plug-ins: TT Toolbox, GH_CPython

path = FilePath("D:\00Dissertation_Discuss\file\third_test\input to cpython.xlsx")
readxl = ReadExcelSheet(Run=Toggle(True), FilePath=path, Worksheet="1", Listen=False)  # -> UserMessages, Columns, Rows
tstat = TreeStatistics(Tree=readxl.Rows)  # -> Paths, Length, Count
cull_i = CullIndex(List=tstat.Paths, Indices="0", Wrap=True)
branch = TreeBranch(Tree=readxl.Rows, Path=cull_i, MaintainPaths=True)
split = SplitList(List=reverse(branch), Index="3")  # -> ListA, reverse(simplify(ListB))
tstat_2 = TreeStatistics(Tree=split.ListB)  # -> Paths, Length, Count
item = ListItem(List=tstat_2.Paths, Index=Slider(3, range=0..9), Wrap=True)
branch_2 = TreeBranch(Tree=split.ListB, Path=item, MaintainPaths=True)
cull_i_2 = CullIndex(List=branch_2, Indices="0", Wrap=True)
panel = Panel(branch_2)
gh_cpython = GH_CPython(input="0", x=cull_i_2)  # -> output, reload_result_batch, average_sun_hour, radiation, visibility; inputs input: list, x: list
#   port input: [required] - [type = int] - [default = None] Descripe your input here * bullet point. * bullet point
#   port output: indicate your output description here. refers to a new line.
# ---------- gh_cpython: Python ----------
import tensorflow as tf
import matplotlib.pyplot as plt
import numpy as np
import pandas as pd


print(np.__version__)
print(pd.__version__)

shape = 15, 29, 35, 3

def array_to_color(array, cmap="Oranges"):
    s_m = plt.cm.ScalarMappable(cmap=cmap)
    return s_m.to_rgba(array)[:,:-1]

def rgb_data_transform(data):
    data_t = []
    for i in range(data.shape[0]):
        data_t.append(array_to_color(data[i]).reshape(shape))
    return np.asarray(data_t, dtype=np.float32)


data_predict = pd.DataFrame(x).transpose()
data_predict = data_predict.to_numpy()
pd_data_predict = pd.DataFrame(data_predict)

data_predict = rgb_data_transform(data_predict)

reload_model = tf.keras.models.load_model("D:/00Dissertation_Discuss/file/third_test/keras_model.h5")
reload_model.summary()

reload_result_batch = reload_model.predict(data_predict)
average_sun_hour = reload_result_batch[0][0]
radiation = reload_result_batch[0][1]
visibility = reload_result_batch[0][2]
# ---------- end gh_cpython ----------
panel_2 = Panel(gh_cpython.reload_result_batch)
panel_3 = Panel(gh_cpython.average_sun_hour)
panel_4 = Panel(gh_cpython.radiation)
panel_5 = Panel(gh_cpython.visibility)
